# Dynamo custom node VRIM.Function.CreateProfileFromFileOnXZ.dyf "CreateProfileFromFileOnXZ" (Dynamo 1.3.2.2480)
# category: VRIM.Function
# Function xz plane

i = Input(i: var[])
StartPt = Input(StartPt:var)
fuction_xz = CodeBlock(i, StartPt)
# ---------- fuction_xz.designscript (1071 lines) ----------
// Copyright(c) 2017, Elisabetta Caterina Giovannini
// Alma Mater Studiorum - University of Bologna
// VRIM project
// www.unibo.it/sitoweb/elisabettacaterina.giovannini/en
// elisabettacaterina.giovannini@unibo.it

i;
StartPt;

FunctionGA (i,StartPt);

def FunctionGA (i: var[],StartPt: var)
{
return = [Imperative]
{
if (i[0]=="1a")
 {
 //Definition for 1a
 H1=(i[11]);
 W1=(i[21]);
 W0= StartPt.X;
 H0= StartPt.Z;
 //Coordinate System (x,z)
 Ax = W0;
 Az = H0;
 Ex = W0+(W1/2);
 Bx = W0+W1;
 Hz = H0+(H1/2);
 Dz = H0+H1;
 //Grid Point
 yPt= StartPt.Y;
 A = Point.ByCoordinates(Ax,yPt,Az);
 E = Point.ByCoordinates(Ex,yPt,Az);
 B = Point.ByCoordinates(Bx,yPt,Az);
 H = Point.ByCoordinates(Ax,yPt,Hz);
 O = Point.ByCoordinates(Ex,yPt,Hz);
 F = Point.ByCoordinates(Bx,yPt,Hz);
 D = Point.ByCoordinates(Ax,yPt,Dz);
 G = Point.ByCoordinates(Ex,yPt,Dz);
 C = Point.ByCoordinates(Bx,yPt,Dz);
 //Func_Geometry
 geometry =Line.ByStartPointEndPoint(A, D);
 //***VRIM***//
 //Architectural Element
 FamilyName=i[2];
 nGA= i[3];
    //Geometry Output;
 IM = {FamilyName,nGA};
 return={geometry, IM, D};
//-------------------------------------------------------------------//
 }
else if (i[0]=="1b")
 {
 //Definition for 1b
 H1=HW[11];
 W1=HW[21];
 W0= StartPt.X;
 H0= StartPt.Z;
 //Local System (x,z)
 Ax = W0;
 Az = H0;
 Ex = W0+(W1/2);
 Bx = W0+W1;
 Hz = H0+(H1/2);
 Dz = H0+H1;
 //9 Points grid
 yPt= StartPt.Y;
 A = Point.ByCoordinates(Ax,yPt,Az);
 E = Point.ByCoordinates(Ex,yPt,Az);
 B = Point.ByCoordinates(Bx,yPt,Az);
 H = Point.ByCoordinates(Ax,yPt,Hz);
 O = Point.ByCoordinates(Ex,yPt,Hz);
 F = Point.ByCoordinates(Bx,yPt,Hz);
 D = Point.ByCoordinates(Ax,yPt,Dz);
 G = Point.ByCoordinates(Ex,yPt,Dz);
 C = Point.ByCoordinates(Bx,yPt,Dz);
 //Geometry 1b
 geometry =Line.ByStartPointEndPoint(A, B);
 //***VRIM***//
 //Architectural Element
 FamilyName=i[2];
 nGA= i[3];
    //Geometry Output;
 IM = {FamilyName,nGA};
 return={geometry, IM, B};
//-------------------------------------------------------------------//
 }
else if (i[0]=="1c")
 {
 //Definition for 1c
 H1=(i[11]);
 W1=(i[21]);
 W0= StartPt.X;
 H0= StartPt.Z;
 //Local System (-x,z)
 Ax = W0-W1;
 Az = H0;
 Ex = W0-(W1/2);
 Bx = W0;
 Hz = H0+(H1/2);
 Dz = H0+H1;
 //9 Points grid
 yPt= StartPt.Y;
 A = Point.ByCoordinates(Ax,yPt,Az);
 E = Point.ByCoordinates(Ex,yPt,Az);
 B = Point.ByCoordinates(Bx,yPt,Az);
 H = Point.ByCoordinates(Ax,yPt,Hz);
 O = Point.ByCoordinates(Ex,yPt,Hz);
 F = Point.ByCoordinates(Bx,yPt,Hz);
 D = Point.ByCoordinates(Ax,yPt,Dz);
 G = Point.ByCoordinates(Ex,yPt,Dz);
 C = Point.ByCoordinates(Bx,yPt,Dz);
 //Geometry 1c
 geometry =Line.ByStartPointEndPoint(B, A);
 //***VRIM***//
 //Architectural Element
 FamilyName=i[2];
 nGA= i[3];
    //Geometry Output;
 IM = {FamilyName,nGA};
 return={geometry, IM, A};
//-------------------------------------------------------------------//
 }
else if (i[0]=="2a")
 {
 //Definition for 2a
 H1=(i[11]);
 W1=(i[21]);
 W0= StartPt.X;
 H0= StartPt.Z;
 //Coordinate System (x,z)
 Ax = W0;
 Az = H0;
 Ex = W0+(W1/2);
 Bx = W0+W1;
 Hz = H0+(H1/2);
 Dz = H0+H1;
 //Grid Point
 yPt= StartPt.Y;
 A = Point.ByCoordinates(Ax,yPt,Az);
 E = Point.ByCoordinates(Ex,yPt,Az);
 B = Point.ByCoordinates(Bx,yPt,Az);
 H = Point.ByCoordinates(Ax,yPt,Hz);
 O = Point.ByCoordinates(Ex,yPt,Hz);
 F = Point.ByCoordinates(Bx,yPt,Hz);
 D = Point.ByCoordinates(Ax,yPt,Dz);
 G = Point.ByCoordinates(Ex,yPt,Dz);
 C = Point.ByCoordinates(Bx,yPt,Dz);
 //Func_Geometry
 t1 = {A, D, C};
 geometry = PolyCurve.ByPoints(t1, false);
 //***VRIM***//
 //Architectural Element
 FamilyName=i[2];
 nGA= i[3];
    //Geometry Output;
 IM = {FamilyName,nGA};
 return={geometry, IM, C};
//-------------------------------------------------------------------//
 }
else if (i[0]=="2b")
 {
 //Definition for 2b
 H1=(i[11]);
 W1=(i[21]);
 W0= StartPt.X;
 H0= StartPt.Z;
 //Coordinate System (x,z)
 Ax = W0;
 Az = H0;
 Ex = W0+(W1/2);
 Bx = W0+W1;
 Hz = H0+(H1/2);
 Dz = H0+H1;
 //Grid Point
 yPt= StartPt.Y;
 A = Point.ByCoordinates(Ax,yPt,Az);
 E = Point.ByCoordinates(Ex,yPt,Az);
 B = Point.ByCoordinates(Bx,yPt,Az);
 H = Point.ByCoordinates(Ax,yPt,Hz);
 O = Point.ByCoordinates(Ex,yPt,Hz);
 F = Point.ByCoordinates(Bx,yPt,Hz);
 D = Point.ByCoordinates(Ax,yPt,Dz);
 G = Point.ByCoordinates(Ex,yPt,Dz);
 C = Point.ByCoordinates(Bx,yPt,Dz);
 //Func_Geometry
 t1 = {A, B, C};
 geometry = PolyCurve.ByPoints(t1, false);
 //***VRIM***//
 //Architectural Element
 FamilyName=i[2];
 nGA= i[3];
    //Geometry Output;
 IM = {FamilyName,nGA};
 return={geometry, IM, C};
//-------------------------------------------------------------------//
 }
else if (i[0]=="2c")
 {
 //Definition for 2c
 H1=(i[11]);
 W1=(i[21]);
 W0= StartPt.X;
 H0= StartPt.Z;
 //Coordinate System (-x,z)
 Ax = W0-W1;
 Az = H0;
 Ex = W0-(W1/2);
 Bx = W0;
 Hz = H0+(H1/2);
 Dz = H0+H1;
 //Grid Point
 yPt= StartPt.Y;
 A = Point.ByCoordinates(Ax,yPt,Az);
 E = Point.ByCoordinates(Ex,yPt,Az);
 B = Point.ByCoordinates(Bx,yPt,Az);
 H = Point.ByCoordinates(Ax,yPt,Hz);
 O = Point.ByCoordinates(Ex,yPt,Hz);
 F = Point.ByCoordinates(Bx,yPt,Hz);
 D = Point.ByCoordinates(Ax,yPt,Dz);
 G = Point.ByCoordinates(Ex,yPt,Dz);
 C = Point.ByCoordinates(Bx,yPt,Dz);
 //Func_Geometry
 t1 = {B, C, D};
 geometry = PolyCurve.ByPoints(t1, false);
 //***VRIM***//
 //Architectural Element
 FamilyName=i[2];
 nGA= i[3];
    //Geometry Output;
 IM = {FamilyName,nGA};
 return={geometry, IM, D};
//-------------------------------------------------------------------//
 }
else if (i[0]=="2d")
 {
 //Definition for 1b
 H1=(i[11]);
 W1=(i[21]);
 W0= StartPt.X;
 H0= StartPt.Z;
 //Local System (-x,z)
 Ax = W0-W1;
 Az = H0;
 Ex = W0-(W1/2);
 Bx = W0;
 Hz = H0+(H1/2);
 Dz = H0+H1;
 //9 Points grid
 yPt= StartPt.Y;
 A = Point.ByCoordinates(Ax,yPt,Az);
 E = Point.ByCoordinates(Ex,yPt,Az);
 B = Point.ByCoordinates(Bx,yPt,Az);
 H = Point.ByCoordinates(Ax,yPt,Hz);
 O = Point.ByCoordinates(Ex,yPt,Hz);
 F = Point.ByCoordinates(Bx,yPt,Hz);
 D = Point.ByCoordinates(Ax,yPt,Dz);
 G = Point.ByCoordinates(Ex,yPt,Dz);
 C = Point.ByCoordinates(Bx,yPt,Dz);
 //Geometry 2d
 t1 = {B, A, D};
 geometry = PolyCurve.ByPoints(t1, false);
 //***VRIM***//
 //Architectural Element
 FamilyName=i[2];
 nGA= i[3];
    //Geometry Output;
 IM = {FamilyName,nGA};
 return={geometry, IM, D};
//-------------------------------------------------------------------//
 }
else if (i[0]=="3a")
 {
 //Definition for 3a
 H1=(i[11]);
 W1=(i[21]);
 W0= StartPt.X;
 H0= StartPt.Z;
 //Local System (x,z)
 Ax = W0;
 Az = H0;
 Ex = W0+(W1/2);
 Bx = W0+W1;
 Hz = H0+(H1/2);
 Dz = H0+H1;
 //9 Points grid
 yPt= StartPt.Y;
 A = Point.ByCoordinates(Ax,yPt,Az);
 E = Point.ByCoordinates(Ex,yPt,Az);
 B = Point.ByCoordinates(Bx,yPt,Az);
 H = Point.ByCoordinates(Ax,yPt,Hz);
 O = Point.ByCoordinates(Ex,yPt,Hz);
 F = Point.ByCoordinates(Bx,yPt,Hz);
 D = Point.ByCoordinates(Ax,yPt,Dz);
 G = Point.ByCoordinates(Ex,yPt,Dz);
 C = Point.ByCoordinates(Bx,yPt,Dz);
 //Geometry 3a
 t1 = {A, D, C, B};
 geometry = PolyCurve.ByPoints(t1, false);
 //***VRIM***//
 //Architectural Element
 FamilyName=i[2];
 nGA= i[3];
    //Geometry Output;
 IM = {FamilyName,nGA};
 return={geometry, IM, B};
//-------------------------------------------------------------------//
 }
else if (i[0]=="3b")
 {
 //Definition for 3b
 H1=(i[11]);
 W1=(i[21]);
 W0= StartPt.X;
 H0= StartPt.Z;
 //Local System (x,z)
 Ax = W0;
 Az = H0;
 Ex = W0+(W1/2);
 Bx = W0+W1;
 Hz = H0+(H1/2);
 Dz = H0+H1;
 //9 Points grid
 yPt= StartPt.Y;
 A = Point.ByCoordinates(Ax,yPt,Az);
 E = Point.ByCoordinates(Ex,yPt,Az);
 B = Point.ByCoordinates(Bx,yPt,Az);
 H = Point.ByCoordinates(Ax,yPt,Hz);
 O = Point.ByCoordinates(Ex,yPt,Hz);
 F = Point.ByCoordinates(Bx,yPt,Hz);
 D = Point.ByCoordinates(Ax,yPt,Dz);
 G = Point.ByCoordinates(Ex,yPt,Dz);
 C = Point.ByCoordinates(Bx,yPt,Dz);
 //Geometry 3b
 t1 = {A, B, C, D};
 geometry = PolyCurve.ByPoints(t1, false);
 //***VRIM***//
 //Architectural Element
 FamilyName=i[2];
 nGA= i[3];
    //Geometry Output;
 IM = {FamilyName,nGA};
 return={geometry, IM, D};
//-------------------------------------------------------------------//
 }
else if (i[0]=="3c")
 {
 //Definition for 3c
 H1=(i[11]);
 W1=(i[21]);
 W0= StartPt.X;
 H0= StartPt.Z;
 //Local System (-x,-z)
 Ax = W0-W1;
 Az = H0-H1;
 Ex = W0-(W1/2);
 Bx = W0;
 Hz = H0-(H1/2);
 Dz = H0;
 //9 Points grid
 yPt= StartPt.Y;
 A = Point.ByCoordinates(Ax,yPt,Az);
 E = Point.ByCoordinates(Ex,yPt,Az);
 B = Point.ByCoordinates(Bx,yPt,Az);
 H = Point.ByCoordinates(Ax,yPt,Hz);
 O = Point.ByCoordinates(Ex,yPt,Hz);
 F = Point.ByCoordinates(Bx,yPt,Hz);
 D = Point.ByCoordinates(Ax,yPt,Dz);
 G = Point.ByCoordinates(Ex,yPt,Dz);
 C = Point.ByCoordinates(Bx,yPt,Dz);
 //Geometry 3c
 t1 = {C, B, A, D};
 geometry = PolyCurve.ByPoints(t1, false);
 //***VRIM***//
 //Architectural Element
 FamilyName=i[2];
 nGA= i[3];
    //Geometry Output;
 IM = {FamilyName,nGA};
 return={geometry, IM, D};
//-------------------------------------------------------------------//
 }
else if (i[0]=="3d")
 {
 //Definition for 3d
 H1=HW[11];
 W1=HW[21];
 W0= StartPt.X;
 H0= StartPt.Z;
 //Local System (-x,z)
 Ax = W0-W1;
 Az = H0;
 Ex = W0-(W1/2);
 Bx = W0;
 Hz = H0+(H1/2);
 Dz = H0+H1;
 //9 Points grid
 yPt= StartPt.Y;
 A = Point.ByCoordinates(Ax,yPt,Az);
 E = Point.ByCoordinates(Ex,yPt,Az);
 B = Point.ByCoordinates(Bx,yPt,Az);
 H = Point.ByCoordinates(Ax,yPt,Hz);
 O = Point.ByCoordinates(Ex,yPt,Hz);
 F = Point.ByCoordinates(Bx,yPt,Hz);
 D = Point.ByCoordinates(Ax,yPt,Dz);
 G = Point.ByCoordinates(Ex,yPt,Dz);
 C = Point.ByCoordinates(Bx,yPt,Dz);
 //Geometry 3d
 t1 = {B, A, D, C};
 geometry = PolyCurve.ByPoints(t1, false);
 //***VRIM***//
 //Architectural Element
 FamilyName=i[2];
 nGA= i[3];
    //Geometry Output;
 IM = {FamilyName,nGA};
 return={geometry, IM, C};
//-------------------------------------------------------------------//
 }
else if (i[0]=="4a")
 {
 //Definition for 4a
 H1=HW[11];
 W1=HW[21];
 W0= StartPt.X;
 H0= StartPt.Z;
 //Local System (x,z)
 Ax = W0;
 Az = H0;
 Ex = W0+(W1/2);
 Bx = W0+W1;
 Hz = H0+(H1/2);
 Dz = H0+H1;
 //9 Points grid
 yPt= StartPt.Y;
 A = Point.ByCoordinates(Ax,yPt,Az);
 E = Point.ByCoordinates(Ex,yPt,Az);
 B = Point.ByCoordinates(Bx,yPt,Az);
 H = Point.ByCoordinates(Ax,yPt,Hz);
 O = Point.ByCoordinates(Ex,yPt,Hz);
 F = Point.ByCoordinates(Bx,yPt,Hz);
 D = Point.ByCoordinates(Ax,yPt,Dz);
 G = Point.ByCoordinates(Ex,yPt,Dz);
 C = Point.ByCoordinates(Bx,yPt,Dz);
 //Geometry 4a
 t1 = {O, E, A};
 t2 = {O, F, C};
 polyCurve1 = PolyCurve.ByPoints(t1, false);
 polyCurve2 = PolyCurve.ByPoints(t2, false);
 geometry = {polyCurve1, polyCurve2};
 //***VRIM***//
 //Architectural Element
 FamilyName=i[2];
 nGA= i[3];
    //Geometry Output;
 IM = {FamilyName,nGA};
 return={geometry, IM, C};
//-------------------------------------------------------------------//
 }
else if (i[0]=="4b")
 {
 //Definition for 4b
 H1=HW[11];
 W1=HW[21];
 W0= StartPt.X;
 H0= StartPt.Z;
 //Local System (x,z)
 Ax = W0;
 Az = H0;
 Ex = W0+(W1/2);
 Bx = W0+W1;
 Hz = H0+(H1/2);
 Dz = H0+H1;
 //9 Points grid
 yPt= StartPt.Y;
 A = Point.ByCoordinates(Ax,yPt,Az);
 E = Point.ByCoordinates(Ex,yPt,Az);
 B = Point.ByCoordinates(Bx,yPt,Az);
 H = Point.ByCoordinates(Ax,yPt,Hz);
 O = Point.ByCoordinates(Ex,yPt,Hz);
 F = Point.ByCoordinates(Bx,yPt,Hz);
 D = Point.ByCoordinates(Ax,yPt,Dz);
 G = Point.ByCoordinates(Ex,yPt,Dz);
 C = Point.ByCoordinates(Bx,yPt,Dz);
 //Geometry 4b
 t1 = {O, H, A};
 t2 = {O, G, C};
 polyCurve1 = PolyCurve.ByPoints(t1, false);
 polyCurve2 = PolyCurve.ByPoints(t2, false);
 geometry = {polyCurve1, polyCurve2};
 //***VRIM***//
 //Architectural Element
 FamilyName=i[2];
 nGA= i[3];
    //Geometry Output;
 IM = {FamilyName,nGA};
 return={geometry, IM, C};
//-------------------------------------------------------------------//
 }
else if (i[0]=="4c")
 {
 //Definition for 4c
 H1=HW[11];
 W1=HW[21];
 W0= StartPt.X;
 H0= StartPt.Z;
 //Local System (-x,z)
 Ax = W0-W1;
 Az = H0;
 Ex = W0-(W1/2);
 Bx = W0;
 Hz = H0+(H1/2);
 Dz = H0+H1;
 //9 Points grid
 yPt= StartPt.Y;
 A = Point.ByCoordinates(Ax,yPt,Az);
 E = Point.ByCoordinates(Ex,yPt,Az);
 B = Point.ByCoordinates(Bx,yPt,Az);
 H = Point.ByCoordinates(Ax,yPt,Hz);
 O = Point.ByCoordinates(Ex,yPt,Hz);
 F = Point.ByCoordinates(Bx,yPt,Hz);
 D = Point.ByCoordinates(Ax,yPt,Dz);
 G = Point.ByCoordinates(Ex,yPt,Dz);
 C = Point.ByCoordinates(Bx,yPt,Dz);
 //Geometry 4c
 t1 = {D, H, O};
 t2 = {B, E, O};
 polyCurve1 = PolyCurve.ByPoints(t1, false);
 polyCurve2 = PolyCurve.ByPoints(t2, false);
 geometry = {polyCurve1, polyCurve2};
 //***VRIM***//
 //Architectural Element
 FamilyName=i[2];
 nGA= i[3];
    //Geometry Output;
 IM = {FamilyName,nGA};
 return={geometry, IM, D};
//-------------------------------------------------------------------//
 }
else if (i[0]=="4d")
 {
 //Definition for 4d
 H1=HW[11];
 W1=HW[21];
 W0= StartPt.X;
 H0= StartPt.Z;
 //Local System (x,z)
 Ax = W0;
 Az = H0;
 Ex = W0+(W1/2);
 Bx = W0+W1;
 Hz = H0+(H1/2);
 Dz = H0+H1;
 //9 Points grid
 yPt= StartPt.Y;
 A = Point.ByCoordinates(Ax,yPt,Az);
 E = Point.ByCoordinates(Ex,yPt,Az);
 B = Point.ByCoordinates(Bx,yPt,Az);
 H = Point.ByCoordinates(Ax,yPt,Hz);
 O = Point.ByCoordinates(Ex,yPt,Hz);
 F = Point.ByCoordinates(Bx,yPt,Hz);
 D = Point.ByCoordinates(Ax,yPt,Dz);
 G = Point.ByCoordinates(Ex,yPt,Dz);
 C = Point.ByCoordinates(Bx,yPt,Dz);
 //Geometry 4d
 t1 = {B, F, O};
 t2 = {D, G, O};
 polyCurve1 = PolyCurve.ByPoints(t1, false);
 polyCurve2 = PolyCurve.ByPoints(t2, false);
 geometry = {polyCurve1, polyCurve2};
 //***VRIM***//
 //Architectural Element
 FamilyName=i[2];
 nGA= i[3];
    //Geometry Output;
 IM = {FamilyName,nGA};
 return={geometry, IM, D};
//-------------------------------------------------------------------//
 }
else if (i[0]=="5a")
 {
 //Definition for 5a
 H1=HW[11];
 W1=HW[21];
 W0= StartPt.X;
 H0= StartPt.Z;
 //Local System (x,z) centered in O grid point
 Ax = W0-(W1/2);
 Az = H0-(H1/2);
 Ex = W0;
 Bx = H0+(H1/2);
 Hz = H0;
 Dz = H0+(H1/2);
 //9 Points grid
 yPt= StartPt.Y;
 A = Point.ByCoordinates(Ax,yPt,Az);
 E = Point.ByCoordinates(Ex,yPt,Az);
 B = Point.ByCoordinates(Bx,yPt,Az);
 H = Point.ByCoordinates(Ax,yPt,Hz);
 O = Point.ByCoordinates(Ex,yPt,Hz);
 F = Point.ByCoordinates(Bx,yPt,Hz);
 D = Point.ByCoordinates(Ax,yPt,Dz);
 G = Point.ByCoordinates(Ex,yPt,Dz);
 C = Point.ByCoordinates(Bx,yPt,Dz);
 //Geometry 5a
 t1 = {C, B, A};
 t2 = {C, D, A};
 polyCurve1 = PolyCurve.ByPoints(t1, false);
 polyCurve2 = PolyCurve.ByPoints(t2, false);
 geometry = {polyCurve1, polyCurve2};
 //***VRIM***//
 //Architectural Element
 FamilyName=i[2];
 nGA= i[3];
    //Geometry Output;
 IM = {FamilyName,nGA};
 return={geometry, IM, O};
//-------------------------------------------------------------------//
 }
else if (i[0]=="6a")
 {
 //Definition for 6a
 H1=(i[11]);
 W1=(i[21]);
 W0= StartPt.X;
 H0= StartPt.Z;
 //Coordinate System (x,z)
 Ax = W0;
 Az = H0;
 Ex = W0+(W1/2);
 Bx = W0+W1;
 Hz = H0+(H1/2);
 Dz = H0+H1;
 //Grid Point
 yPt= StartPt.Y;
 A = Point.ByCoordinates(Ax,yPt,Az);
 E = Point.ByCoordinates(Ex,yPt,Az);
 B = Point.ByCoordinates(Bx,yPt,Az);
 H = Point.ByCoordinates(Ax,yPt,Hz);
 O = Point.ByCoordinates(Ex,yPt,Hz);
 F = Point.ByCoordinates(Bx,yPt,Hz);
 D = Point.ByCoordinates(Ax,yPt,Dz);
 G = Point.ByCoordinates(Ex,yPt,Dz);
 C = Point.ByCoordinates(Bx,yPt,Dz);
 //Func_Geometry
 vector1 = Vector.ByTwoPoints(B, A);
 vector2 = Vector.ByTwoPoints(B, C);
 geometry = Arc.ByStartEndAndTangencies(A, vector1, C, vector2);
 //***VRIM***//
 //Architectural Element
 FamilyName=i[2];
 nGA= i[3];
    //Geometry Output;
 IM = {FamilyName,nGA};
 return={geometry, IM, C};
//-------------------------------------------------------------------//
 }
else if (i[0]=="6b")
 {
 //Definition for 6b
 H1=(i[11]);
 W1=(i[21]);
 W0= StartPt.X;
 H0= StartPt.Z;
 //Coordinate System (x,z)
 Ax = W0;
 Az = H0;
 Ex = W0+(W1/2);
 Bx = W0+W1;
 Hz = H0+(H1/2);
 Dz = H0+H1;
 //Grid Point
 yPt= StartPt.Y;
 A = Point.ByCoordinates(Ax,yPt,Az);
 E = Point.ByCoordinates(Ex,yPt,Az);
 B = Point.ByCoordinates(Bx,yPt,Az);
 H = Point.ByCoordinates(Ax,yPt,Hz);
 O = Point.ByCoordinates(Ex,yPt,Hz);
 F = Point.ByCoordinates(Bx,yPt,Hz);
 D = Point.ByCoordinates(Ax,yPt,Dz);
 G = Point.ByCoordinates(Ex,yPt,Dz);
 C = Point.ByCoordinates(Bx,yPt,Dz);
 //Func_Geometry
 vector1 = Vector.ByTwoPoints(D, A);
 vector2 = Vector.ByTwoPoints(D, C);
 geometry = Arc.ByStartEndAndTangencies(A, vector1, C, vector2);
 //***VRIM***//
 //Architectural Element
 FamilyName=i[2];
 nGA= i[3];
    //Geometry Output;
 IM = {FamilyName,nGA};
 return={geometry, IM, C};
//-------------------------------------------------------------------//
 }
else if (i[0]=="6c")
 {
 //Definition for 6c
 H1=(i[11]);
 W1=(i[21]);
 W0= StartPt.X;
 H0= StartPt.Z;
 //Coordinate System (-x,z)
 Ax = W0-W1;
 Az = H0;
 Ex = W0-(W1/2);
 Bx = W0;
 Hz = H0+(H1/2);
 Dz = H0+H1;
 //Grid Point
 yPt= StartPt.Y;
 A = Point.ByCoordinates(Ax,yPt,Az);
 E = Point.ByCoordinates(Ex,yPt,Az);
 B = Point.ByCoordinates(Bx,yPt,Az);
 H = Point.ByCoordinates(Ax,yPt,Hz);
 O = Point.ByCoordinates(Ex,yPt,Hz);
 F = Point.ByCoordinates(Bx,yPt,Hz);
 D = Point.ByCoordinates(Ax,yPt,Dz);
 G = Point.ByCoordinates(Ex,yPt,Dz);
 C = Point.ByCoordinates(Bx,yPt,Dz);
 //Func_Geometry
 vector1 = Vector.ByTwoPoints(A, B);
 vector2 = Vector.ByTwoPoints(A, D);
 geometry = Arc.ByStartEndAndTangencies(B, vector1, D, vector2);
 //***VRIM***//
 //Architectural Element
 FamilyName=i[2];
 nGA= i[3];
    //Geometry Output;
 IM = {FamilyName,nGA};
 return={geometry, IM, D};
//-------------------------------------------------------------------//

//-------------------------------------------------------------------//
 }
else if (i[0]=="7a")
 {
 //Definition for 7a
 H1=(i[11]);
 W1=(i[21]);
 W0= StartPt.X;
 H0= StartPt.Z;
 //Coordinate System (x,z)
 Ax = W0;
 Az = H0;
 Ex = W0+(W1/2);
 Bx = W0+W1;
 Hz = H0+(H1/2);
 Dz = H0+H1;
 //Grid Point
 yPt= StartPt.Y;
 A = Point.ByCoordinates(Ax,yPt,Az);
 E = Point.ByCoordinates(Ex,yPt,Az);
 B = Point.ByCoordinates(Bx,yPt,Az);
 H = Point.ByCoordinates(Ax,yPt,Hz);
 O = Point.ByCoordinates(Ex,yPt,Hz);
 F = Point.ByCoordinates(Bx,yPt,Hz);
 D = Point.ByCoordinates(Ax,yPt,Dz);
 G = Point.ByCoordinates(Ex,yPt,Dz);
 C = Point.ByCoordinates(Bx,yPt,Dz);
 //Func_Geometry
 vector1 = Vector.ByTwoPoints(E, O);
 vector2 = Vector.ByTwoPoints(E, A);
 vector3 = Vector.ByTwoPoints(G, O);
 vector4 = Vector.ByTwoPoints(G, D);
 arc1 = Arc.ByStartEndAndTangencies(O, vector1, A, vector2);
 arc2 = Arc.ByStartEndAndTangencies(O, vector3, D, vector4);
 geometry = {arc1, arc2};
 //***VRIM***//
 //Architectural Element
 FamilyName=i[2];
 nGA= i[3];
    //Geometry Output;
 IM = {FamilyName,nGA};
 return={geometry, IM, D};
//-------------------------------------------------------------------//
 }
else if (i[0]=="7b")
 {
 //Definition for 7b
 H1=HW[11];
 W1=HW[21];
 W0= StartPt.X;
 H0= StartPt.Z;
 //Local System (-x,-z)
 Ax = W0-W1;
 Az = H0-H1;
 Ex = W0-(W1/2);
 Bx = W0;
 Hz = H0-(H1*2);
 Dz = H0;
 //9 Points grid
 yPt= StartPt.Y;
 A = Point.ByCoordinates(Ax,yPt,Az);
 E = Point.ByCoordinates(Ex,yPt,Az);
 B = Point.ByCoordinates(Bx,yPt,Az);
 H = Point.ByCoordinates(Ax,yPt,Hz);
 O = Point.ByCoordinates(Ex,yPt,Hz);
 F = Point.ByCoordinates(Bx,yPt,Hz);
 D = Point.ByCoordinates(Ax,yPt,Dz);
 G = Point.ByCoordinates(Ex,yPt,Dz);
 C = Point.ByCoordinates(Bx,yPt,Dz);
 //Geometry 7b
 r1 = W1/2;
 r2 = H1;
 plane = Plane.ByThreePoints(G, D, O);
 geometry = EllipseArc.ByPlaneRadiiAngles(plane, r2, r1, -90, 180);
 //***VRIM***//
 //Architectural Element
 FamilyName=i[2];
 nGA= i[3];
    //Geometry Output;
 IM = {FamilyName,nGA};
 return={geometry, IM, D};
//-------------------------------------------------------------------//
 }
else if (i[0]=="7c")
 {
 //Definition for 7c
 H1=HW[11];
 W1=HW[21];
 W0= StartPt.X;
 H0= StartPt.Z;
 //Local System (-x,z)
 Ax = W0-(W1*2);
 Az = H0;
 Ex = W0-W1;
 Bx = W0;
 Hz = H0+(H1/2);
 Dz = H0+H1;
 //9 Points grid
 yPt= StartPt.Y;
 A = Point.ByCoordinates(Ax,yPt,Az);
 E = Point.ByCoordinates(Ex,yPt,Az);
 B = Point.ByCoordinates(Bx,yPt,Az);
 H = Point.ByCoordinates(Ax,yPt,Hz);
 O = Point.ByCoordinates(Ex,yPt,Hz);
 F = Point.ByCoordinates(Bx,yPt,Hz);
 D = Point.ByCoordinates(Ax,yPt,Dz);
 G = Point.ByCoordinates(Ex,yPt,Dz);
 C = Point.ByCoordinates(Bx,yPt,Dz);
 //Geometry 7c
 r1 = W1;
 r2 = H1/2;
 plane = Plane.ByThreePoints(F, C, O);
 geometry = EllipseArc.ByPlaneRadiiAngles(plane, r1, r2, -90, 180);
 //***VRIM***//
 //Architectural Element
 FamilyName=i[2];
 nGA= i[3];
    //Geometry Output;
 IM = {FamilyName,nGA};
 return={geometry, IM, D};
//-------------------------------------------------------------------//
 }
else if (i[0]=="7d")
 {
 //Definition for 7d
 H1=HW[11];
 W1=HW[21];
 W0= StartPt.X;
 H0= StartPt.Z;
 //Local System (x,z)
 Ax = W0;
 Az = H0;
 Ex = W0+(W1/2);
 Bx = W0+W1;
 Hz = H0+H1;
 Dz = H0+(H1*2);
 //9 Points grid
 yPt= StartPt.Y;
 A = Point.ByCoordinates(Ax,yPt,Az);
 E = Point.ByCoordinates(Ex,yPt,Az);
 B = Point.ByCoordinates(Bx,yPt,Az);
 H = Point.ByCoordinates(Ax,yPt,Hz);
 O = Point.ByCoordinates(Ex,yPt,Hz);
 F = Point.ByCoordinates(Bx,yPt,Hz);
 D = Point.ByCoordinates(Ax,yPt,Dz);
 G = Point.ByCoordinates(Ex,yPt,Dz);
 C = Point.ByCoordinates(Bx,yPt,Dz);
 //Geometry 7d
 r1 = W1/2;
 r2 = H1;
 plane = Plane.ByThreePoints(E, O, A);
 geometry = EllipseArc.ByPlaneRadiiAngles(plane, r1, r2, 0, 180);
 //***VRIM***//
 //Architectural Element
 FamilyName=i[2];
 nGA= i[3];
    //Geometry Output;
 IM = {FamilyName,nGA};
 return={geometry, IM, D};
//-------------------------------------------------------------------//
 }
else if (i[0]=="8a")
 {
 //Definition for 8a
 H1=(i[11]);
 W1=(i[21]);
 W0= StartPt.X;
 H0= StartPt.Z;
 //Coordinate System (x,z)
 Ax = W0;
 Az = H0;
 Ex = W0+(W1/2);
 Bx = W0+W1;
 Hz = H0+(H1/2);
 Dz = H0+H1;
 //Grid Point
 yPt= StartPt.Y;
 A = Point.ByCoordinates(Ax,yPt,Az);
 E = Point.ByCoordinates(Ex,yPt,Az);
 B = Point.ByCoordinates(Bx,yPt,Az);
 H = Point.ByCoordinates(Ax,yPt,Hz);
 O = Point.ByCoordinates(Ex,yPt,Hz);
 F = Point.ByCoordinates(Bx,yPt,Hz);
 D = Point.ByCoordinates(Ax,yPt,Dz);
 G = Point.ByCoordinates(Ex,yPt,Dz);
 C = Point.ByCoordinates(Bx,yPt,Dz);
 //Func_Geometry
 vector1 = Vector.ByTwoPoints(H, O);
 vector2 = Vector.ByTwoPoints(H, A);
 vector3 = Vector.ByTwoPoints(F, O);
 vector4 = Vector.ByTwoPoints(F, C);
 arc1 = Arc.ByStartEndAndTangencies(O, vector1, A, vector2);
 arc2 = Arc.ByStartEndAndTangencies(O, vector3, C, vector4);
 geometry = {arc1, arc2};
 //***VRIM***//
 //Architectural Element
 FamilyName=i[2];
 nGA= i[3];
    //Geometry Output;
 IM = {FamilyName,nGA};
 return={geometry, IM, C};
//-------------------------------------------------------------------//
 }
else if (i[0]=="8b")
 {
 //Definition for 8b

 //***VRIM***//
 //Architectural Element
 FamilyName=i[2];
 nGA= i[3];
    //Geometry Output;
 IM = {FamilyName,nGA};
 return={geometry, IM, C};
//-------------------------------------------------------------------//
 }
else if (i[0]=="8c")
 {
 //Definition for 8c

 //***VRIM***//
 //Architectural Element
 FamilyName=i[2];
 nGA= i[3];
    //Geometry Output;
 IM = {FamilyName,nGA};
 return={geometry, IM, C};
//-------------------------------------------------------------------//
 }
else if (i[0]=="8d")
 {
 //Definition for 8d
 H1=(i[11]);
 W1=(i[21]);
 W0= StartPt.X;
 H0= StartPt.Z;
 //Coordinate System (-x,z)
 Ax = W0-W1;
 Az = H0;
 Ex = W0-(W1/2);
 Bx = W0;
 Hz = H0+(H1/2);
 Dz = H0+H1;
 //Grid Point
 yPt= StartPt.Y;
 A = Point.ByCoordinates(Ax,yPt,Az);
 E = Point.ByCoordinates(Ex,yPt,Az);
 B = Point.ByCoordinates(Bx,yPt,Az);
 H = Point.ByCoordinates(Ax,yPt,Hz);
 O = Point.ByCoordinates(Ex,yPt,Hz);
 F = Point.ByCoordinates(Bx,yPt,Hz);
 D = Point.ByCoordinates(Ax,yPt,Dz);
 G = Point.ByCoordinates(Ex,yPt,Dz);
 C = Point.ByCoordinates(Bx,yPt,Dz);
 //Func_Geometry
 vector1 = Vector.ByTwoPoints(E, O);
 vector2 = Vector.ByTwoPoints(E, B);
 vector3 = Vector.ByTwoPoints(G, O);
 vector4 = Vector.ByTwoPoints(G, D);
 arc1 = Arc.ByStartEndAndTangencies(O, vector1, B, vector2);
 arc2 = Arc.ByStartEndAndTangencies(O, vector3, D, vector4);
 geometry = {arc1, arc2};
 //***VRIM***//
 //Architectural Element
 FamilyName=i[2];
 nGA= i[3];
    //Geometry Output;
 IM = {FamilyName,nGA};
 return={geometry, IM, D};
//-------------------------------------------------------------------//
 }
else if (i[0]=="9a")
 {
 //Definition for 9a

 //***VRIM***//
 //Architectural Element
 FamilyName=i[2];
 nGA= i[3];
    //Geometry Output;
 IM = {FamilyName,nGA};
 return={geometry, IM, C};
//-------------------------------------------------------------------//
 }
else if (i[0]=="9b")
 {
 //Definition for 9b

 //***VRIM***//
 //Architectural Element
 FamilyName=i[2];
 nGA= i[3];
    //Geometry Output;
 IM = {FamilyName,nGA};
 return={geometry, IM, C};
//-------------------------------------------------------------------//
 }
else if (i[0]=="9c")
 {
 //Definition for 9c

 //***VRIM***//
 //Architectural Element
 FamilyName=i[2];
 nGA= i[3];
    //Geometry Output;
 IM = {FamilyName,nGA};
 return={geometry, IM, C};
//-------------------------------------------------------------------//
 }
else if (i[0]=="9d")
 {
 //Definition for 9d

 //***VRIM***//
 //Architectural Element
 FamilyName=i[2];
 nGA= i[3];
    //Geometry Output;
 IM = {FamilyName,nGA};
 return={geometry, IM, C};
//-------------------------------------------------------------------//
 }
else if (i[0]=="10a")
 {
 //Definition for 10a

 //***VRIM***//
 //Architectural Element
 FamilyName=i[2];
 nGA= i[3];
    //Geometry Output;
 IM = {FamilyName,nGA};
 return={geometry, IM, C};
//-------------------------------------------------------------------//
 }
}
};
# ----------------------------------------
watch = Watch(fuction_xz.out1)
watch_2 = Watch(fuction_xz.out0)
watch_3 = Watch(fuction_xz.out2)
code_block = CodeBlock(listEl=watch_3) { listEl[0]; listEl[1]; listEl[2]; }
Moulding = Output(code_block.out0)
Info = Output(code_block.out1)
EndPoint = Output(code_block.out2)
