# Dynamo custom node VRIM.Geometry.world XY.03.3b.dyf "3b" (Dynamo 1.3.2.2480)
# category: VRIM.Geometry.world XY.03

HW = Input(HW:double[]={10,10})
StartPt = Input(StartPt: var=Point.ByCoordinates(0,0,0))
n3b_xy = CodeBlock(HW, StartPt)  # "3b_xy"
# ---------- n3b_xy.designscript (36 lines) ----------
// Copyright(c) 2017, Elisabetta Caterina Giovannini
// Alma Mater Studiorum - University of Bologna
// VRIM project
// www.unibo.it/sitoweb/elisabettacaterina.giovannini/en
// elisabettacaterina.giovannini@unibo.it

//Measurements - 3b
H1=HW[0];
W1=HW[1];
W0= StartPt.X;
H0= StartPt.Y;

//Local System (x,y)
Ax = W0;
Ay = H0;
Ex = W0+(W1/2);
Bx = W0+W1;
Hy = H0+(H1/2);
Dy = H0+H1;

//9 Points grid
zPt= StartPt.Z;
A = Point.ByCoordinates(Ax,Ay,zPt);
E = Point.ByCoordinates(Ex,Ay,zPt);
B = Point.ByCoordinates(Bx,Ay,zPt);
H = Point.ByCoordinates(Ax,Hy,zPt);
O = Point.ByCoordinates(Ex,Hy,zPt);
F = Point.ByCoordinates(Bx,Hy,zPt);
D = Point.ByCoordinates(Ax,Dy,zPt);
G = Point.ByCoordinates(Ex,Dy,zPt);
C = Point.ByCoordinates(Bx,Dy,zPt);

//Geometry 3b
t1 = {A, B, C, D};
geometry3b = PolyCurve.ByPoints(t1, false);
GeometryOutput= {geometry3b, D};
# ----------------------------------------
code_block = CodeBlock(OUT=n3b_xy.GeometryOutput) { InfoGeom=OUT[0]; End=OUT[1]; }
n3b = Output(code_block.InfoGeom)  # "3b"
EndPt = Output(code_block.End)
