# Dynamo custom node VRIM.Geometry.world XY.04.4b.dyf "4b" (Dynamo 1.3.2.2480)
# category: VRIM.Geometry.world XY.04

HW = Input(HW:double[]={10,10})
StartPt = Input(StartPt: var=Point.ByCoordinates(0,0,0))
n4b_xy = CodeBlock(HW, StartPt)  # "4b_xy"
# ---------- n4b_xy.designscript (40 lines) ----------
// Copyright(c) 2017, Elisabetta Caterina Giovannini
// Alma Mater Studiorum - University of Bologna
// VRIM project
// www.unibo.it/sitoweb/elisabettacaterina.giovannini/en
// elisabettacaterina.giovannini@unibo.it

//Measurements - 4b
H1=HW[0];
W1=HW[1];
W0= StartPt.X;
H0= StartPt.Y;

//Local System (x,y)
Ax = W0;
Ay = H0;
Ex = W0+(W1/2);
Bx = W0+W1;
Hy = H0+(H1/2);
Dy = H0+H1;

//9 Points grid
zPt= StartPt.Z;
A = Point.ByCoordinates(Ax,Ay,zPt);
E = Point.ByCoordinates(Ex,Ay,zPt);
B = Point.ByCoordinates(Bx,Ay,zPt);
H = Point.ByCoordinates(Ax,Hy,zPt);
O = Point.ByCoordinates(Ex,Hy,zPt);
F = Point.ByCoordinates(Bx,Hy,zPt);
D = Point.ByCoordinates(Ax,Dy,zPt);
G = Point.ByCoordinates(Ex,Dy,zPt);
C = Point.ByCoordinates(Bx,Dy,zPt);

//Geometry 4b
t1 = {O, H, A};
t2 = {O, G, C};
polyCurve1 = PolyCurve.ByPoints(t1, false);
polyCurve2 = PolyCurve.ByPoints(t2, false);
geometry4b = {polyCurve1, polyCurve2};
JoinCurves = PolyCurve.ByJoinedCurves(geometry4b);
GeometryOutput= {JoinCurves, C};
# ----------------------------------------
code_block = CodeBlock(OUT=n4b_xy.GeometryOutput) { InfoGeom=OUT[0]; End=OUT[1]; }
n4b = Output(code_block.InfoGeom)  # "4b"
EndPt = Output(code_block.End)
