# Dynamo custom node VRIM.Geometry.world XY.06.6d.dyf "6d" (Dynamo 1.3.2.2480)
# category: VRIM.Geometry.world XY.06

HW = Input(HW:double[]={10,10})
StartPt = Input(StartPt: var=Point.ByCoordinates(0,0,0))
n6d_xy = CodeBlock(HW, StartPt)  # "6d_xy"
# ---------- n6d_xy.designscript (66 lines) ----------
// Copyright(c) 2017, Elisabetta Caterina Giovannini
// Alma Mater Studiorum - University of Bologna
// VRIM project
// www.unibo.it/sitoweb/elisabettacaterina.giovannini/en
// elisabettacaterina.giovannini@unibo.it

//Measurements - 6d
H1=HW[0];
W1=HW[1];
W0= StartPt.X;
H0= StartPt.Y;

//Local System (-x,y)
Ax = W0-W1;
Ay = H0;
Ex = W0-(W1/2);
Bx = W0;
Hy = H0+(H1/2);
Dy = H0+H1;

//9 Points grid
zPt= StartPt.Z;
A = Point.ByCoordinates(Ax,Ay,zPt);
E = Point.ByCoordinates(Ex,Ay,zPt);
B = Point.ByCoordinates(Bx,Ay,zPt);
H = Point.ByCoordinates(Ax,Hy,zPt);
O = Point.ByCoordinates(Ex,Hy,zPt);
F = Point.ByCoordinates(Bx,Hy,zPt);
D = Point.ByCoordinates(Ax,Dy,zPt);
G = Point.ByCoordinates(Ex,Dy,zPt);
C = Point.ByCoordinates(Bx,Dy,zPt);

//Geometry 6d
geometry6b = [Imperative]
{
if(H1>W1)
{
//Geometry 6d arc
plane1 = Plane.ByThreePoints(B, F, E);
plane2 = Plane.ByThreePoints(D, F, G);
x1 = B.DistanceTo(D);
circle1 = Circle.ByPlaneRadius(plane1, x1);
circle2 = Circle.ByPlaneRadius(plane2, x1);
ip1 = circle1.Intersect(circle2);
p1 = ip1[0];
p2 = ip1[1];
v1 = Vector.ByTwoPoints(p2, p1);
v2 = Vector.ByTwoPoints(B, A);
l1 = Line.ByStartPointDirectionLength(p2, v1, 3000);
l2 = Line.ByStartPointDirectionLength(B, v2, 3000);
intP = l1.Intersect(l2);
geometry6d = Arc.ByCenterPointStartPointEndPoint(intP, D, B);
JoinCurves = PolyCurve.ByJoinedCurves(geometry6d);
return= {JoinCurves, D};
}
else
{
//Geometry 6d ellipse
r1 = W1;
r2 = H1;
plane = Plane.ByThreePoints(A, B, D);
geometry6d = EllipseArc.ByPlaneRadiiAngles(plane, r2, r1, 90, -90);
JoinCurves = PolyCurve.ByJoinedCurves(geometry6d);
return= {JoinCurves, D};
}
};
# ----------------------------------------
code_block = CodeBlock(OUT=n6d_xy.out20) { InfoGeom=OUT[0]; End=OUT[1]; }
n6d = Output(code_block.InfoGeom)  # "6d"
EndPt = Output(code_block.End)
