# Dynamo custom node VRIM.Geometry.world XY.07.7c.dyf "7c" (Dynamo 1.3.2.2480)
# category: VRIM.Geometry.world XY.07

HW = Input(HW:double[]={10,5})
StartPt = Input(StartPt: var=Point.ByCoordinates(0,0,0))
n7c_xy = CodeBlock(HW, StartPt)  # "7c_xy"
# ---------- n7c_xy.designscript (39 lines) ----------
// Copyright(c) 2017, Elisabetta Caterina Giovannini
// Alma Mater Studiorum - University of Bologna
// VRIM project
// www.unibo.it/sitoweb/elisabettacaterina.giovannini/en
// elisabettacaterina.giovannini@unibo.it

//Measurements - 7c
H1=HW[0];
W1=HW[1];
W0= StartPt.X;
H0= StartPt.Y;

//Local System (-x,y)
Ax = W0-(W1*2);
Ay = H0;
Ex = W0-W1;
Bx = W0;
Hy = H0+(H1/2);
Dy = H0+H1;

//9 Points grid
zPt= StartPt.Z;
A = Point.ByCoordinates(Ax,Ay,zPt);
E = Point.ByCoordinates(Ex,Ay,zPt);
B = Point.ByCoordinates(Bx,Ay,zPt);
H = Point.ByCoordinates(Ax,Hy,zPt);
O = Point.ByCoordinates(Ex,Hy,zPt);
F = Point.ByCoordinates(Bx,Hy,zPt);
D = Point.ByCoordinates(Ax,Dy,zPt);
G = Point.ByCoordinates(Ex,Dy,zPt);
C = Point.ByCoordinates(Bx,Dy,zPt);

//Geometry 7c
r1 = W1;
r2 = H1/2;
plane = Plane.ByThreePoints(F, C, O);
geometry7c = EllipseArc.ByPlaneRadiiAngles(plane, r1, r2, -90, 180);
JoinCurves = PolyCurve.ByJoinedCurves(geometry7c);
geometryOutput= {JoinCurves, D};
# ----------------------------------------
code_block = CodeBlock(OUT=n7c_xy.geometryOutput) { InfoGeom=OUT[0]; End=OUT[1]; }
n7c = Output(code_block.InfoGeom)  # "7c"
EndPt = Output(code_block.End)
