# Dynamo custom node VRIM.Geometry.world XY.07.7d.dyf "7d" (Dynamo 1.3.2.2480)
# category: VRIM.Geometry.world XY.07

HW = Input(HW:double[]={5,10})
StartPt = Input(StartPt: var=Point.ByCoordinates(0,0,0))
n7d_xy = CodeBlock(HW, StartPt)  # "7d_xy"
# ---------- n7d_xy.designscript (40 lines) ----------
// Copyright(c) 2017, Elisabetta Caterina Giovannini
// Alma Mater Studiorum - University of Bologna
// VRIM project
// www.unibo.it/sitoweb/elisabettacaterina.giovannini/en
// elisabettacaterina.giovannini@unibo.it

//Measurements - 7d
H1=HW[0];
W1=HW[1];
W0= StartPt.X;
H0= StartPt.Y;


//Local System (x,y)
Ax = W0;
Ay = H0;
Ex = W0+(W1/2);
Bx = W0+W1;
Hy = H0+H1;
Dy = H0+(H1*2);

//9 Points grid
zPt= StartPt.Z;
A = Point.ByCoordinates(Ax,Ay,zPt);
E = Point.ByCoordinates(Ex,Ay,zPt);
B = Point.ByCoordinates(Bx,Ay,zPt);
H = Point.ByCoordinates(Ax,Hy,zPt);
O = Point.ByCoordinates(Ex,Hy,zPt);
F = Point.ByCoordinates(Bx,Hy,zPt);
D = Point.ByCoordinates(Ax,Dy,zPt);
G = Point.ByCoordinates(Ex,Dy,zPt);
C = Point.ByCoordinates(Bx,Dy,zPt);

//Geometry 7d
r1 = W1/2;
r2 = H1;
plane = Plane.ByThreePoints(E, O, A);
geometry7d = EllipseArc.ByPlaneRadiiAngles(plane, r1, r2, 0, 180);
JoinCurves = PolyCurve.ByJoinedCurves(geometry7d);
geometryOutput= {JoinCurves, D};
# ----------------------------------------
code_block = CodeBlock(OUT=n7d_xy.geometryOutput) { InfoGeom=OUT[0]; End=OUT[1]; }
n7d = Output(code_block.InfoGeom)  # "7d"
EndPt = Output(code_block.End)
