# Dynamo custom node VRIM.Geometry.world XY.08.8a.dyf "8a" (Dynamo 1.3.2.2480)
# category: VRIM.Geometry.world XY.08

HW = Input(HW:double[]={10,10})
StartPt = Input(StartPt: var=Point.ByCoordinates(0,0,0))
n8a_xy = CodeBlock(HW, StartPt)  # "8a_xy"
# ---------- n8a_xy.designscript (71 lines) ----------
// Copyright(c) 2017, Elisabetta Caterina Giovannini
// Alma Mater Studiorum - University of Bologna
// VRIM project
// www.unibo.it/sitoweb/elisabettacaterina.giovannini/en
// elisabettacaterina.giovannini@unibo.it

//Measurements - Profile 8a
H1=HW[0];
W1=HW[1];
W0= StartPt.X;
H0= StartPt.Y;

//Coordinate System (x,y)
Ax = W0;
Ay = H0;
Ex = W0+(W1/2);
Bx = W0+W1;
Hy = H0+(H1/2);
Dy = H0+H1;

//9 Points grid
zPt= StartPt.Z;
A = Point.ByCoordinates(Ax,Ay,zPt);
E = Point.ByCoordinates(Ex,Ay,zPt);
B = Point.ByCoordinates(Bx,Ay,zPt);
H = Point.ByCoordinates(Ax,Hy,zPt);
O = Point.ByCoordinates(Ex,Hy,zPt);
F = Point.ByCoordinates(Bx,Hy,zPt);
D = Point.ByCoordinates(Ax,Dy,zPt);
G = Point.ByCoordinates(Ex,Dy,zPt);
C = Point.ByCoordinates(Bx,Dy,zPt);

geometry = [Imperative]
{
if(H1>W1)
{
//Geometry
r1 = W1/2;
r2 = H1/2;
planeE = Plane.ByThreePoints(H, E, O);
planeH = Plane.ByThreePoints(F, C, O);
Arc1 = EllipseArc.ByPlaneRadiiAngles(planeE, r1, r2, 0, 90);
Arc2 = EllipseArc.ByPlaneRadiiAngles(planeH, r1, r2, 0, 90);
geometry8a = {Arc1, Arc2};
JoinCurves = PolyCurve.ByJoinedCurves(geometry8a);
return= {JoinCurves, C};
}
else
{
//Geometry
x1 = A.DistanceTo(C);
r=((x1/14)*6);
planeA = Plane.ByThreePoints(A, E, H);
planeO = Plane.ByThreePoints(O, F, G);
planeC = Plane.ByThreePoints(C, G, F);
circleA = Circle.ByPlaneRadius(planeA, r);
circleO = Circle.ByPlaneRadius(planeO, r);
circleC = Circle.ByPlaneRadius(planeC, r);
ipA = circleO.Intersect(circleA);
ipC = circleO.Intersect(circleC);
p1 = ipA[0];
p2 = ipA[1];
p3 = ipC[0];
p4 = ipC[1];
Arc1 = Arc.ByCenterPointStartPointEndPoint(p2, O, A);
Arc2 = Arc.ByCenterPointStartPointEndPoint(p3, O, C);
geometry8a = {Arc1, Arc2};
JoinCurves = PolyCurve.ByJoinedCurves(geometry8a);
return= {JoinCurves, C};
}
};
# ----------------------------------------
code_block = CodeBlock(OUT=n8a_xy.out20) { InfoGeom=OUT[0]; End=OUT[1]; }
n8a = Output(code_block.InfoGeom)  # "8a"
EndPt = Output(code_block.End)
