# Dynamo custom node VRIM.Geometry.world XY.08.8b.dyf "8b" (Dynamo 1.3.2.2480)
# category: VRIM.Geometry.world XY.08

HW = Input(HW:double[]={10,10})
StartPt = Input(StartPt: var=Point.ByCoordinates(0,0,0))
n8b_xy = CodeBlock(HW, StartPt)  # "8b_xy"
# ---------- n8b_xy.designscript (72 lines) ----------
// Copyright(c) 2017, Elisabetta Caterina Giovannini
// Alma Mater Studiorum - University of Bologna
// VRIM project
// www.unibo.it/sitoweb/elisabettacaterina.giovannini/en
// elisabettacaterina.giovannini@unibo.it

//Measurements - 8b
H1=HW[0];
W1=HW[1];
W0= StartPt.X;
H0= StartPt.Y;

//Local System (x,y)
Ax = W0;
Ay = H0;
Ex = W0+(W1/2);
Bx = W0+W1;
Hy = H0+(H1/2);
Dy = H0+H1;

//9 Points grid
zPt= StartPt.Z;
A = Point.ByCoordinates(Ax,Ay,zPt);
E = Point.ByCoordinates(Ex,Ay,zPt);
B = Point.ByCoordinates(Bx,Ay,zPt);
H = Point.ByCoordinates(Ax,Hy,zPt);
O = Point.ByCoordinates(Ex,Hy,zPt);
F = Point.ByCoordinates(Bx,Hy,zPt);
D = Point.ByCoordinates(Ax,Dy,zPt);
G = Point.ByCoordinates(Ex,Dy,zPt);
C = Point.ByCoordinates(Bx,Dy,zPt);

//Geometry 8b
geometry8b = [Imperative]
{
if(H1>W1)
{
//Geometry by ellipse
r1 = W1/2;
r2 = H1/2;
planeE = Plane.ByThreePoints(E, O, A);
planeH = Plane.ByThreePoints(G, O, C);
Arc1 = EllipseArc.ByPlaneRadiiAngles(planeE, r1, r2, 0, 90);
Arc2 = EllipseArc.ByPlaneRadiiAngles(planeH, r1, r2, 0, 90);
geometry8b = {Arc1, Arc2};
JoinCurves = PolyCurve.ByJoinedCurves(geometry8b);
return= {JoinCurves, C};
}
else
{
//Geometry by arc
x1 = A.DistanceTo(C);
r=((x1/14)*6);
planeA = Plane.ByThreePoints(A, E, H);
planeO = Plane.ByThreePoints(O, F, G);
planeC = Plane.ByThreePoints(C, G, F);
circleA = Circle.ByPlaneRadius(planeA, r);
circleO = Circle.ByPlaneRadius(planeO, r);
circleC = Circle.ByPlaneRadius(planeC, r);
ipA = circleO.Intersect(circleA);
ipC = circleO.Intersect(circleC);
p1 = ipA[0];
p2 = ipA[1];
p3 = ipC[0];
p4 = ipC[1];
Arc1 = Arc.ByCenterPointStartPointEndPoint(p1, A, O);
Arc2 = Arc.ByCenterPointStartPointEndPoint(p4, C, O);
geometry8b = {Arc1, Arc2};
JoinCurves = PolyCurve.ByJoinedCurves(geometry8b);
return= {JoinCurves, C};
}
};
# ----------------------------------------
code_block = CodeBlock(OUT=n8b_xy.out20) { InfoGeom=OUT[0]; End=OUT[1]; }
n8b = Output(code_block.InfoGeom)  # "8b"
EndPt = Output(code_block.End)
