# Dynamo custom node VRIM.Geometry.world XY.09.9b.dyf "9b" (Dynamo 1.3.2.2480)
# category: VRIM.Geometry.world XY.09

HW = Input(HW:double[]={10,10})
StartPt = Input(StartPt: var=Point.ByCoordinates(0,0,0))
n9b_xy = CodeBlock(HW, StartPt)  # "9b_xy"
# ---------- n9b_xy.designscript (39 lines) ----------
// Copyright(c) 2017, Elisabetta Caterina Giovannini
// Alma Mater Studiorum - University of Bologna
// VRIM project
// www.unibo.it/sitoweb/elisabettacaterina.giovannini/en
// elisabettacaterina.giovannini@unibo.it

//Measurements - 9b
H1=HW[0];
W1=HW[1];
W0= StartPt.X;
H0= StartPt.Y;

//Local System (-x,z) centered in E grid point
Ax = W0-(W1/2);
Ay = H0;
Ex = W0;
Bx = W0+(W1/2);
Hy = H0+(H1/2);
Dy = H0+H1;

//9 Points grid
zPt= StartPt.Z;
A = Point.ByCoordinates(Ax,Ay,zPt);
E = Point.ByCoordinates(Ex,Ay,zPt);
B = Point.ByCoordinates(Bx,Ay,zPt);
H = Point.ByCoordinates(Ax,Hy,zPt);
O = Point.ByCoordinates(Ex,Hy,zPt);
F = Point.ByCoordinates(Bx,Hy,zPt);
D = Point.ByCoordinates(Ax,Dy,zPt);
G = Point.ByCoordinates(Ex,Dy,zPt);
C = Point.ByCoordinates(Bx,Dy,zPt);

//Geometry 9b
r1 = W1/2;
r2 = H1/2;
plane = Plane.ByThreePoints(O, G, H);
geometry9b = EllipseArc.ByPlaneRadiiAngles(plane, r1, r2, 0, 270);
JoinCurves = PolyCurve.ByJoinedCurves(geometry9b);
GeometryOutput= {JoinCurves, H};
# ----------------------------------------
code_block = CodeBlock(OUT=n9b_xy.GeometryOutput) { InfoGeom=OUT[0]; End=OUT[1]; }
n9b = Output(code_block.InfoGeom)  # "9b"
EndPt = Output(code_block.End)
