# Dynamo custom node VRIM.Geometry.world XZ.01.1b.dyf "1b" (Dynamo 1.3.2.2480)
# category: VRIM.Geometry.world XZ.01

HW = Input(HW:double[]={10,10})
StartPt = Input(StartPt: var=Point.ByCoordinates(0,0,0))
n1b = CodeBlock(HW, StartPt)  # "1b"
# ---------- n1b.designscript (36 lines) ----------
// Copyright(c) 2017, Elisabetta Caterina Giovannini
// Alma Mater Studiorum - University of Bologna
// VRIM project
// www.unibo.it/sitoweb/elisabettacaterina.giovannini/en
// elisabettacaterina.giovannini@unibo.it

//Measurements - 1b
H1=HW[0];
W1=HW[1];
W0= StartPt.X;
H0= StartPt.Z;

//Local System (x,z)
Ax = W0;
Az = H0;
Ex = W0+(W1/2);
Bx = W0+W1;
Hz = H0+(H1/2);
Dz = H0+H1;

//9 Points grid
yPt= StartPt.Y;
A = Point.ByCoordinates(Ax,yPt,Az);
E = Point.ByCoordinates(Ex,yPt,Az);
B = Point.ByCoordinates(Bx,yPt,Az);
H = Point.ByCoordinates(Ax,yPt,Hz);
O = Point.ByCoordinates(Ex,yPt,Hz);
F = Point.ByCoordinates(Bx,yPt,Hz);
D = Point.ByCoordinates(Ax,yPt,Dz);
G = Point.ByCoordinates(Ex,yPt,Dz);
C = Point.ByCoordinates(Bx,yPt,Dz);

//Geometry 1b
geometry1b =Line.ByStartPointEndPoint(A, B);
JoinCurves = PolyCurve.ByJoinedCurves(geometry1b);
GeometryOutput= {JoinCurves, B};
# ----------------------------------------
code_block = CodeBlock(OUT=n1b.GeometryOutput) { InfoGeom=OUT[0]; End=OUT[1]; }
n1b_2 = Output(code_block.InfoGeom)  # "1b"
EndPt = Output(code_block.End)
