# Dynamo custom node VRIM.Geometry.world XZ.04.4b.dyf "4b" (Dynamo 1.3.2.2480)
# category: VRIM.Geometry.world XZ.04

HW = Input(HW:double[]={10,10})
StartPt = Input(StartPt: var=Point.ByCoordinates(0,0,0))
n4b = CodeBlock(HW, StartPt)  # "4b"
# ---------- n4b.designscript (40 lines) ----------
// Copyright(c) 2017, Elisabetta Caterina Giovannini
// Alma Mater Studiorum - University of Bologna
// VRIM project
// www.unibo.it/sitoweb/elisabettacaterina.giovannini/en
// elisabettacaterina.giovannini@unibo.it

//Measurements - 4b
H1=HW[0];
W1=HW[1];
W0= StartPt.X;
H0= StartPt.Z;

//Local System (x,z)
Ax = W0;
Az = H0;
Ex = W0+(W1/2);
Bx = W0+W1;
Hz = H0+(H1/2);
Dz = H0+H1;

//9 Points grid
yPt= StartPt.Y;
A = Point.ByCoordinates(Ax,yPt,Az);
E = Point.ByCoordinates(Ex,yPt,Az);
B = Point.ByCoordinates(Bx,yPt,Az);
H = Point.ByCoordinates(Ax,yPt,Hz);
O = Point.ByCoordinates(Ex,yPt,Hz);
F = Point.ByCoordinates(Bx,yPt,Hz);
D = Point.ByCoordinates(Ax,yPt,Dz);
G = Point.ByCoordinates(Ex,yPt,Dz);
C = Point.ByCoordinates(Bx,yPt,Dz);

//Geometry 4b
t1 = {O, H, A};
t2 = {O, G, C};
polyCurve1 = PolyCurve.ByPoints(t1, false);
polyCurve2 = PolyCurve.ByPoints(t2, false);
JoinCurves = {polyCurve1, polyCurve2};
geometry4b = PolyCurve.ByJoinedCurves(JoinCurves);
GeometryOutput= {geometry4b, C};
# ----------------------------------------
code_block = CodeBlock(OUT=n4b.GeometryOutput) { InfoGeom=OUT[0]; End=OUT[1]; }
n4b_2 = Output(code_block.InfoGeom)  # "4b"
EndPt = Output(code_block.End)
