# Dynamo custom node VRIM.Geometry.world XZ.05.5a.dyf "5a" (Dynamo 1.3.2.2480)
# category: VRIM.Geometry.world XZ.05

HW = Input(HW:double[]={10,10})
StartPt = Input(StartPt: var=Point.ByCoordinates(0,0,0))
n5a = CodeBlock(HW, StartPt)  # "5a"
# ---------- n5a.designscript (40 lines) ----------
// Copyright(c) 2017, Elisabetta Caterina Giovannini
// Alma Mater Studiorum - University of Bologna
// VRIM project
// www.unibo.it/sitoweb/elisabettacaterina.giovannini/en
// elisabettacaterina.giovannini@unibo.it

//Measurements - 5a
H1=HW[0];
W1=HW[1];
W0= StartPt.X;
H0= StartPt.Z;

//Local System (x,z) centered in O grid point
Ax = W0-(W1/2);
Az = H0-(H1/2);
Ex = W0;
Bx = H0+(H1/2);
Hz = H0;
Dz = H0+(H1/2);

//9 Points grid
yPt= StartPt.Y;
A = Point.ByCoordinates(Ax,yPt,Az);
E = Point.ByCoordinates(Ex,yPt,Az);
B = Point.ByCoordinates(Bx,yPt,Az);
H = Point.ByCoordinates(Ax,yPt,Hz);
O = Point.ByCoordinates(Ex,yPt,Hz);
F = Point.ByCoordinates(Bx,yPt,Hz);
D = Point.ByCoordinates(Ax,yPt,Dz);
G = Point.ByCoordinates(Ex,yPt,Dz);
C = Point.ByCoordinates(Bx,yPt,Dz);

//Geometry 5a
t1 = {C, B, A};
t2 = {C, D, A};
polyCurve1 = PolyCurve.ByPoints(t1, false);
polyCurve2 = PolyCurve.ByPoints(t2, false);
JoinCurves = {polyCurve1, polyCurve2};
geometry5a = PolyCurve.ByJoinedCurves(JoinCurves);
GeometryOutput= {geometry5a, C};
# ----------------------------------------
code_block = CodeBlock(OUT=n5a.GeometryOutput) { InfoGeom=OUT[0]; End=OUT[1]; }
n5a_2 = Output(code_block.InfoGeom)  # "5a"
EndPt = Output(code_block.End)
