# Dynamo custom node VRIM.Geometry.world XZ.06.6c.dyf "6c" (Dynamo 1.3.2.2480)
# category: VRIM.Geometry.world XZ.06

HW = Input(HW:double[]={10,10})
StartPt = Input(StartPt: var=Point.ByCoordinates(0,0,0))
n6c = CodeBlock(HW, StartPt)  # "6c"
# ---------- n6c.designscript (66 lines) ----------
// Copyright(c) 2017, Elisabetta Caterina Giovannini
// Alma Mater Studiorum - University of Bologna
// VRIM project
// www.unibo.it/sitoweb/elisabettacaterina.giovannini/en
// elisabettacaterina.giovannini@unibo.it

//Measurements - 6c
H1=HW[0];
W1=HW[1];
W0= StartPt.X;
H0= StartPt.Z;

//Local System (-x,z)
Ax = W0-W1;
Az = H0;
Ex = W0-(W1/2);
Bx = W0;
Hz = H0+(H1/2);
Dz = H0+H1;

//9 Points grid
yPt= StartPt.Y;
A = Point.ByCoordinates(Ax,yPt,Az);
E = Point.ByCoordinates(Ex,yPt,Az);
B = Point.ByCoordinates(Bx,yPt,Az);
H = Point.ByCoordinates(Ax,yPt,Hz);
O = Point.ByCoordinates(Ex,yPt,Hz);
F = Point.ByCoordinates(Bx,yPt,Hz);
D = Point.ByCoordinates(Ax,yPt,Dz);
G = Point.ByCoordinates(Ex,yPt,Dz);
C = Point.ByCoordinates(Bx,yPt,Dz);

//Geometry 6c
geometry6b = [Imperative]
{
if(H1>W1)
{
//Geometry 6c arc
plane1 = Plane.ByThreePoints(B, F, E);
plane2 = Plane.ByThreePoints(D, F, G);
x1 = B.DistanceTo(D);
circle1 = Circle.ByPlaneRadius(plane1, x1);
circle2 = Circle.ByPlaneRadius(plane2, x1);
ip1 = circle1.Intersect(circle2);
p1 = ip1[0];
p2 = ip1[1];
v1 = Vector.ByTwoPoints(p1, p2);
v2 = Vector.ByTwoPoints(D, C);
l1 = Line.ByStartPointDirectionLength(p1, v1, 3000);
l2 = Line.ByStartPointDirectionLength(D, v2, 3000);
intP = l1.Intersect(l2);
geometry6c = Arc.ByCenterPointStartPointEndPoint(intP, B, D);
JoinCurves = PolyCurve.ByJoinedCurves(geometry6c);
return= {JoinCurves, D};
}
else
{
//Geometry 6c ellipse
r1 = W1;
r2 = H1;
plane = Plane.ByThreePoints(C, G, F);
geometry6c = EllipseArc.ByPlaneRadiiAngles(plane, r2, r1, 90, -90);
JoinCurves = PolyCurve.ByJoinedCurves(geometry6c);
return= {JoinCurves, D};
}
};
# ----------------------------------------
code_block = CodeBlock(OUT=n6c.out20) { InfoGeom=OUT[0]; End=OUT[1]; }
n6c_2 = Output(code_block.InfoGeom)  # "6c"
EndPt = Output(code_block.End)
