# Dynamo custom node VRIM.Geometry.world XZ.08.8a.dyf "8a" (Dynamo 1.3.2.2480)
# category: VRIM.Geometry.world XZ.08

HW = Input(HW:double[]={10,10})
StartPt = Input(StartPt: var=Point.ByCoordinates(0,0,0))
n8a = CodeBlock(HW, StartPt)  # "8a"
# ---------- n8a.designscript (72 lines) ----------
// Copyright(c) 2017, Elisabetta Caterina Giovannini
// Alma Mater Studiorum - University of Bologna
// VRIM project
// www.unibo.it/sitoweb/elisabettacaterina.giovannini/en
// elisabettacaterina.giovannini@unibo.it

//Measurements - 8a
H1=HW[0];
W1=HW[1];
W0= StartPt.X;
H0= StartPt.Z;

//Local System (x,z)
Ax = W0;
Az = H0;
Ex = W0+(W1/2);
Bx = W0+W1;
Hz = H0+(H1/2);
Dz = H0+H1;

//9 Points grid
yPt= StartPt.Y;
A = Point.ByCoordinates(Ax,yPt,Az);
E = Point.ByCoordinates(Ex,yPt,Az);
B = Point.ByCoordinates(Bx,yPt,Az);
H = Point.ByCoordinates(Ax,yPt,Hz);
O = Point.ByCoordinates(Ex,yPt,Hz);
F = Point.ByCoordinates(Bx,yPt,Hz);
D = Point.ByCoordinates(Ax,yPt,Dz);
G = Point.ByCoordinates(Ex,yPt,Dz);
C = Point.ByCoordinates(Bx,yPt,Dz);

//Geometry 8a
geometry8a = [Imperative]
{
if(H1>W1)
{
//Geometry by ellipse
r1 = W1/2;
r2 = H1/2;
planeE = Plane.ByThreePoints(E, O, A);
planeH = Plane.ByThreePoints(G, O, C);
Arc1 = EllipseArc.ByPlaneRadiiAngles(planeE, r1, r2, 0, 90);
Arc2 = EllipseArc.ByPlaneRadiiAngles(planeH, r1, r2, 0, 90);
geometry8a = {Arc1, Arc2};
JoinCurves = PolyCurve.ByJoinedCurves(geometry8a);
return= {JoinCurves, C};
}
else
{
//Geometry by arc
x1 = A.DistanceTo(C);
r=((x1/14)*6);
planeA = Plane.ByThreePoints(A, E, H);
planeO = Plane.ByThreePoints(O, F, G);
planeC = Plane.ByThreePoints(C, G, F);
circleA = Circle.ByPlaneRadius(planeA, r);
circleO = Circle.ByPlaneRadius(planeO, r);
circleC = Circle.ByPlaneRadius(planeC, r);
ipA = circleO.Intersect(circleA);
ipC = circleO.Intersect(circleC);
p1 = ipA[0];
p2 = ipA[1];
p3 = ipC[0];
p4 = ipC[1];
Arc1 = Arc.ByCenterPointStartPointEndPoint(p1, A, O);
Arc2 = Arc.ByCenterPointStartPointEndPoint(p4, C, O);
geometry8a = {Arc1, Arc2};
JoinCurves = PolyCurve.ByJoinedCurves(geometry8a);
return= {JoinCurves, C};
}
};
# ----------------------------------------
code_block = CodeBlock(OUT=n8a.out20) { InfoGeom=OUT[0]; End=OUT[1]; }
n8a_2 = Output(code_block.InfoGeom)  # "8a"
EndPt = Output(code_block.End)
