# Dynamo custom node VRIM.Geometry.world XZ.08.8d.dyf "8d" (Dynamo 1.3.2.2480)
# category: VRIM.Geometry.world XZ.08

HW = Input(HW:double[]={10,10})
StartPt = Input(StartPt: var=Point.ByCoordinates(0,0,0))
n8d = CodeBlock(HW, StartPt)  # "8d"
# ---------- n8d.designscript (72 lines) ----------
// Copyright(c) 2017, Elisabetta Caterina Giovannini
// Alma Mater Studiorum - University of Bologna
// VRIM project
// www.unibo.it/sitoweb/elisabettacaterina.giovannini/en
// elisabettacaterina.giovannini@unibo.it

//Measurements - 8d
H1=HW[0];
W1=HW[1];
W0= StartPt.X;
H0= StartPt.Z;

//Coordinate System(-x,z)
Ax = W0-W1;
Az = H0;
Ex = W0-(W1/2);
Bx = W0;
Hz = H0+(H1/2);
Dz = H0+H1;

//9 Points grid
yPt= StartPt.Y;
A = Point.ByCoordinates(Ax,yPt,Az);
E = Point.ByCoordinates(Ex,yPt,Az);
B = Point.ByCoordinates(Bx,yPt,Az);
H = Point.ByCoordinates(Ax,yPt,Hz);
O = Point.ByCoordinates(Ex,yPt,Hz);
F = Point.ByCoordinates(Bx,yPt,Hz);
D = Point.ByCoordinates(Ax,yPt,Dz);
G = Point.ByCoordinates(Ex,yPt,Dz);
C = Point.ByCoordinates(Bx,yPt,Dz);

//Geometry 8d
geometry8d = [Imperative]
{
if(H1>W1)
{
//Geometry by ellipse
r1 = W1/2;
r2 = H1/2;
planeF = Plane.ByThreePoints(F, C, O);
planeH = Plane.ByThreePoints(H, E, O);
Arc1 = EllipseArc.ByPlaneRadiiAngles(planeF, r1, r2, -90, 90);
Arc2 = EllipseArc.ByPlaneRadiiAngles(planeH, r1, r2, 0, -90);
geometry8d = {Arc1, Arc2};
JoinCurves = PolyCurve.ByJoinedCurves(geometry8d);
return= {JoinCurves, D};
}
else
{
//Geometry by arc
x1 = B.DistanceTo(D);
r=((x1/14)*6);
planeB = Plane.ByThreePoints(B, F, E);
planeO = Plane.ByThreePoints(O, G, H);
planeD = Plane.ByThreePoints(D, H, G);
circleB = Circle.ByPlaneRadius(planeB, r);
circleO = Circle.ByPlaneRadius(planeO, r);
circleD = Circle.ByPlaneRadius(planeD, r);
ipB = circleO.Intersect(circleB);
ipD = circleO.Intersect(circleD);
p1 = ipB[1];
p2 = ipB[0];
p3 = ipD[1];
p4 = ipD[0];
Arc1 = Arc.ByCenterPointStartPointEndPoint(p1, B, O);
Arc2 = Arc.ByCenterPointStartPointEndPoint(p4, D, O);
geometry8d = {Arc1, Arc2};
JoinCurves = PolyCurve.ByJoinedCurves(geometry8d);
return= {JoinCurves, D};
}
};
# ----------------------------------------
code_block = CodeBlock(OUT=n8d.out20) { InfoGeom=OUT[0]; End=OUT[1]; }
n8d_2 = Output(code_block.InfoGeom)  # "8d"
EndPt = Output(code_block.End)
