# Dynamo custom node VRIM.Geometry.world XZ.09.9c.dyf "9c" (Dynamo 1.3.2.2480)
# category: VRIM.Geometry.world XZ.09

HW = Input(HW:double[]={10,10})
StartPt = Input(StartPt: var=Point.ByCoordinates(0,0,0))
n9c = CodeBlock(HW, StartPt)  # "9c"
# ---------- n9c.designscript (39 lines) ----------
// Copyright(c) 2017, Elisabetta Caterina Giovannini
// Alma Mater Studiorum - University of Bologna
// VRIM project
// www.unibo.it/sitoweb/elisabettacaterina.giovannini/en
// elisabettacaterina.giovannini@unibo.it

//Measurements - 9c
H1=HW[0];
W1=HW[1];
W0= StartPt.X;
H0= StartPt.Z;

//Local System (x,z) centered in F grid point
Ax = W0-W1;
Az = H0-(H1/2);
Ex = W0-(W1/2);
Bx = W0;
Hz = H0;
Dz = H0+(H1/2);

//9 Points grid
yPt= StartPt.Y;
A = Point.ByCoordinates(Ax,yPt,Az);
E = Point.ByCoordinates(Ex,yPt,Az);
B = Point.ByCoordinates(Bx,yPt,Az);
H = Point.ByCoordinates(Ax,yPt,Hz);
O = Point.ByCoordinates(Ex,yPt,Hz);
F = Point.ByCoordinates(Bx,yPt,Hz);
D = Point.ByCoordinates(Ax,yPt,Dz);
G = Point.ByCoordinates(Ex,yPt,Dz);
C = Point.ByCoordinates(Bx,yPt,Dz);

//Geometry 9c
r1 = W1/2;
r2 = H1/2;
plane = Plane.ByThreePoints(O, G, H);
geometry9c = EllipseArc.ByPlaneRadiiAngles(plane, r1, r2, 180, 270);
JoinCurves = PolyCurve.ByJoinedCurves(geometry9c);
GeometryOutput= {JoinCurves, G};
# ----------------------------------------
code_block = CodeBlock(OUT=n9c.GeometryOutput) { InfoGeom=OUT[0]; End=OUT[1]; }
n9c_2 = Output(code_block.InfoGeom)  # "9c"
EndPt = Output(code_block.End)
