# Dynamo custom node VRIM.ProfilesAndPaths.CloseProfile.dyf "CloseProfile" (Dynamo 1.3.2.2480)
# category: VRIM.ProfilesAndPaths

StartPt = Input()
EndPt = Input()
Moulding = Input()
closeProfile = CodeBlock(StartPt=StartPt, EndPt=EndPt, Moulding=Moulding)
# ---------- closeProfile.designscript (20 lines) ----------
// Copyright(c) 2017, Elisabetta Caterina Giovannini
// Alma Mater Studiorum - University of Bologna
// VRIM project
// www.unibo.it/sitoweb/elisabettacaterina.giovannini/en
// elisabettacaterina.giovannini@unibo.it

// Punti di inizio e fine CloseProfile
StartPt;
EndPt;
W = Point.ByCoordinates(StartPt.X,EndPt.Y,EndPt.Z);
t1 = {StartPt, W, EndPt};
Profile = PolyCurve.ByPoints(t1, false);
GetProfile = {Moulding, Profile};
// Close Profile and filter geometries from List
UnionList= Flatten(GetProfile);
SelectNumbers=DSCore.Object.Type(UnionList);
SeparateGeometries=String.Contains(SelectNumbers, "System", false);
FilterGeometries=List.FilterByBoolMask(UnionList, SeparateGeometries);
GetCurves=__TryGetValueFromNestedDictionaries(FilterGeometries, "out");
polyCurve = PolyCurve.ByJoinedCurves(GetCurves);
# ----------------------------------------
Profile = Output(closeProfile.polyCurve)
Same_Sequence = Output(closeProfile.StartPt)
