# Dynamo custom node VRIM.Function.CreateProfileFromFileOnXY.dyf "CreateProfileFromFileOnXY" (Dynamo 1.3.2.2480)
# category: VRIM.Function
# GeometricalAtom

i = Input(i: var[])
StartPt = Input(StartPt:var)
fuctionGA_xy = CodeBlock(i, StartPt)
# ---------- fuctionGA_xy.designscript (57 lines) ----------
// Copyright(c) 2017, Elisabetta Caterina Giovannini
// Alma Mater Studiorum - University of Bologna
// VRIM project
// www.unibo.it/sitoweb/elisabettacaterina.giovannini/en
// elisabettacaterina.giovannini@unibo.it

i;
StartPt;

FunctionGA (i,StartPt);

def FunctionGA (i: var[],StartPt: var)
{
return = [Imperative]
{
if (i[0]=="3a")
 {
 //Definition for 1a
 H1=(i[11]);
 W1=(i[21]);
 W0= StartPt.X;
 H0= StartPt.Y;
 //Coordinate System (x,y)
 Ox = W0;
 Oy = H0;
 Ax = W0-(W1/2);
 Ay = H0-(H1/2);
 Bx = W0+(W1/2);
 Cy = H0+(H1/2);

 //Grid Point
 zPt= StartPt.Z;
 A = Point.ByCoordinates(Ax,Ay,zPt);
 E = Point.ByCoordinates(Ox,Ay,zPt);
 B = Point.ByCoordinates(Bx,Ay,zPt);
 H = Point.ByCoordinates(Ax,Oy,zPt);
 O = Point.ByCoordinates(Ox,Oy,zPt);
 F = Point.ByCoordinates(Bx,Oy,zPt);
 D = Point.ByCoordinates(Ax,Cy,zPt);
 G = Point.ByCoordinates(Ox,Cy,zPt);
 C = Point.ByCoordinates(Bx,Cy,zPt);

 //Func_Geometry
 t1 = {A, D, C, B};
 geometry = PolyCurve.ByPoints(t1, false);

 //***VRIM***//
 //Architectural Element
 FamilyName=i[2];
 nGA= i[3];

    //Geometry Output;
 IM = {FamilyName,nGA};
 return={geometry, IM, B};
 }
}
};
# ----------------------------------------
watch = Watch(fuctionGA_xy.out2)
code_block = CodeBlock(listEl=watch) { listEl[0]; listEl[1]; listEl[2]; }
EndPoint = Output(code_block.out2)
Info = Output(code_block.out1)
Moulding = Output(code_block.out0)
watch_2 = Watch(fuctionGA_xy.out0)
watch_3 = Watch(fuctionGA_xy.out1)
