# Dynamo custom node VRIM.Geometry.world XY.01.1a.dyf "1a" (Dynamo 1.3.2.2480)
# category: VRIM.Geometry.world XY.01.Actions

HW = Input(HW:double[]={10,10})
StartPt = Input(StartPt: var=Point.ByCoordinates(0,0,0))
n1a_xy = CodeBlock(HW, StartPt)  # "1a_xy"
# ---------- n1a_xy.designscript (36 lines) ----------
// Copyright(c) 2017, Elisabetta Caterina Giovannini
// Alma Mater Studiorum - University of Bologna
// VRIM project
// www.unibo.it/sitoweb/elisabettacaterina.giovannini/en
// elisabettacaterina.giovannini@unibo.it

//Measurements - 1a
H1=HW[0];
W1=HW[1];
W0= StartPt.X;
H0= StartPt.Y;

//Local System (x,y)
Ax = W0;
Ay = H0;
Ex = W0+(W1/2);
Bx = W0+W1;
Hy = H0+(H1/2);
Dy = H0+H1;

//9 Points grid
zPt= StartPt.Z;
A = Point.ByCoordinates(Ax,Ay,zPt);
E = Point.ByCoordinates(Ex,Ay,zPt);
B = Point.ByCoordinates(Bx,Ay,zPt);
H = Point.ByCoordinates(Ax,Hy,zPt);
O = Point.ByCoordinates(Ex,Hy,zPt);
F = Point.ByCoordinates(Bx,Hy,zPt);
D = Point.ByCoordinates(Ax,Dy,zPt);
G = Point.ByCoordinates(Ex,Dy,zPt);
C = Point.ByCoordinates(Bx,Dy,zPt);

//Geometry 1a
geometry1a =Line.ByStartPointEndPoint(A, D);
JoinCurves = PolyCurve.ByJoinedCurves(geometry1a);
GeometryOutput= {JoinCurves, D};
# ----------------------------------------
code_block = CodeBlock(OUT=n1a_xy.GeometryOutput) { InfoGeom=OUT[0]; End=OUT[1]; }
n1a = Output(code_block.InfoGeom)  # "1a"
EndPt = Output(code_block.End)
