# Dynamo custom node VRIM.Geometry.world XY.02.2d.dyf "2d" (Dynamo 1.3.2.2480)
# category: VRIM.Geometry.world XY.02

HW = Input(HW:double[]={10,10})
StartPt = Input(StartPt: var=Point.ByCoordinates(0,0,0))
n2d_xy = CodeBlock(HW, StartPt)  # "2d_xy"
# ---------- n2d_xy.designscript (36 lines) ----------
// Copyright(c) 2017, Elisabetta Caterina Giovannini
// Alma Mater Studiorum - University of Bologna
// VRIM project
// www.unibo.it/sitoweb/elisabettacaterina.giovannini/en
// elisabettacaterina.giovannini@unibo.it

//Measurements - 2d
H1=HW[0];
W1=HW[1];
W0= StartPt.X;
H0= StartPt.Y;

//Local System (-x,y)
Ax = W0-W1;
Ay = H0;
Ex = W0-(W1/2);
Bx = W0;
Hy = H0+(H1/2);
Dy = H0+H1;

//9 Points grid
zPt= StartPt.Z;
A = Point.ByCoordinates(Ax,Ay,zPt);
E = Point.ByCoordinates(Ex,Ay,zPt);
B = Point.ByCoordinates(Bx,Ay,zPt);
H = Point.ByCoordinates(Ax,Hy,zPt);
O = Point.ByCoordinates(Ex,Hy,zPt);
F = Point.ByCoordinates(Bx,Hy,zPt);
D = Point.ByCoordinates(Ax,Dy,zPt);
G = Point.ByCoordinates(Ex,Dy,zPt);
C = Point.ByCoordinates(Bx,Dy,zPt);

//Geometry 2d
t1 = {D, A, B};
geometry2d = PolyCurve.ByPoints(t1, false);
Geometryoutput= {geometry2d, D};
# ----------------------------------------
code_block = CodeBlock(OUT=n2d_xy.Geometryoutput) { InfoGeom=OUT[0]; End=OUT[1]; }
n2d = Output(code_block.InfoGeom)  # "2d"
EndPt = Output(code_block.End)
