# Dynamo custom node VRIM.Geometry.world XY.04.4c.dyf "4c" (Dynamo 1.3.2.2480)
# category: VRIM.Geometry.world XY.04

HW = Input(HW:double[]={10,10})
StartPt = Input(StartPt: var=Point.ByCoordinates(0,0,0))
n4c_xy = CodeBlock(HW, StartPt)  # "4c_xy"
# ---------- n4c_xy.designscript (40 lines) ----------
// Copyright(c) 2017, Elisabetta Caterina Giovannini
// Alma Mater Studiorum - University of Bologna
// VRIM project
// www.unibo.it/sitoweb/elisabettacaterina.giovannini/en
// elisabettacaterina.giovannini@unibo.it

//Measurements - 4c
H1=HW[0];
W1=HW[1];
W0= StartPt.X;
H0= StartPt.Y;

//Local System (-x,y)
Ax = W0-W1;
Ay = H0;
Ex = W0-(W1/2);
Bx = W0;
Hy = H0+(H1/2);
Dy = H0+H1;

//9 Points grid
zPt= StartPt.Z;
A = Point.ByCoordinates(Ax,Ay,zPt);
E = Point.ByCoordinates(Ex,Ay,zPt);
B = Point.ByCoordinates(Bx,Ay,zPt);
H = Point.ByCoordinates(Ax,Hy,zPt);
O = Point.ByCoordinates(Ex,Hy,zPt);
F = Point.ByCoordinates(Bx,Hy,zPt);
D = Point.ByCoordinates(Ax,Dy,zPt);
G = Point.ByCoordinates(Ex,Dy,zPt);
C = Point.ByCoordinates(Bx,Dy,zPt);

//Geometry 4c
t1 = {D, H, O};
t2 = {B, E, O};
polyCurve1 = PolyCurve.ByPoints(t1, false);
polyCurve2 = PolyCurve.ByPoints(t2, false);
geometry4c = {polyCurve1, polyCurve2};
JoinCurves = PolyCurve.ByJoinedCurves(geometry4c);
GeometryOutput= {JoinCurves, D};
# ----------------------------------------
code_block = CodeBlock(OUT=n4c_xy.GeometryOutput) { InfoGeom=OUT[0]; End=OUT[1]; }
n4c = Output(code_block.InfoGeom)  # "4c"
EndPt = Output(code_block.End)
