# Dynamo custom node VRIM.Geometry.world XY.05.5a.dyf "5a" (Dynamo 1.3.2.2480)
# category: VRIM.Geometry.world XY.05

HW = Input(HW:double[]={10,10})
StartPt = Input(StartPt: var=Point.ByCoordinates(0,0,0))
n5a_xy = CodeBlock(HW, StartPt)  # "5a_xy"
# ---------- n5a_xy.designscript (40 lines) ----------
// Copyright(c) 2017, Elisabetta Caterina Giovannini
// Alma Mater Studiorum - University of Bologna
// VRIM project
// www.unibo.it/sitoweb/elisabettacaterina.giovannini/en
// elisabettacaterina.giovannini@unibo.it

//Measurements - 5a
H1=HW[0];
W1=HW[1];
W0= StartPt.X;
H0= StartPt.Y;

//Local System (x,y) centered in O grid point
Ax = W0-(W1/2);
Ay = H0-(H1/2);
Ex = W0;
Bx = H0+(H1/2);
Hy = H0;
Dy = H0+(H1/2);

//9 Points grid
zPt= StartPt.Z;
A = Point.ByCoordinates(Ax,Ay,zPt);
E = Point.ByCoordinates(Ex,Ay,zPt);
B = Point.ByCoordinates(Bx,Ay,zPt);
H = Point.ByCoordinates(Ax,Hy,zPt);
O = Point.ByCoordinates(Ex,Hy,zPt);
F = Point.ByCoordinates(Bx,Hy,zPt);
D = Point.ByCoordinates(Ax,Dy,zPt);
G = Point.ByCoordinates(Ex,Dy,zPt);
C = Point.ByCoordinates(Bx,Dy,zPt);

//Geometry 5a
t1 = {A, B, C};
t2 = {C, D, A};
polyCurve1 = PolyCurve.ByPoints(t1, false);
polyCurve2 = PolyCurve.ByPoints(t2, false);
geometry5a = {polyCurve1, polyCurve2};
JoinCurves = PolyCurve.ByJoinedCurves(geometry5a);
GeometryOutput= {JoinCurves, O};
# ----------------------------------------
code_block = CodeBlock(OUT=n5a_xy.GeometryOutput) { InfoGeom=OUT[0]; End=OUT[1]; }
n5a = Output(code_block.InfoGeom)  # "5a"
EndPt = Output(code_block.End)
