# Dynamo custom node VRIM.Geometry.world XY.06.6a.dyf "6a" (Dynamo 1.3.2.2480)
# category: VRIM.Geometry.world XY.06

HW = Input(HW:double[]={10,10})
StartPt = Input(StartPt: var=Point.ByCoordinates(0,0,0))
n6a_xy = CodeBlock(HW, StartPt)  # "6a_xy"
# ---------- n6a_xy.designscript (66 lines) ----------
// Copyright(c) 2017, Elisabetta Caterina Giovannini
// Alma Mater Studiorum - University of Bologna
// VRIM project
// www.unibo.it/sitoweb/elisabettacaterina.giovannini/en
// elisabettacaterina.giovannini@unibo.it

//Measurements - 6a
H1=HW[0];
W1=HW[1];
W0= StartPt.X;
H0= StartPt.Y;

//Local System (x,y)
Ax = W0;
Ay = H0;
Ex = W0+(W1/2);
Bx = W0+W1;
Hy = H0+(H1/2);
Dy = H0+H1;

//9 Points grid
zPt= StartPt.Z;
A = Point.ByCoordinates(Ax,Ay,zPt);
E = Point.ByCoordinates(Ex,Ay,zPt);
B = Point.ByCoordinates(Bx,Ay,zPt);
H = Point.ByCoordinates(Ax,Hy,zPt);
O = Point.ByCoordinates(Ex,Hy,zPt);
F = Point.ByCoordinates(Bx,Hy,zPt);
D = Point.ByCoordinates(Ax,Dy,zPt);
G = Point.ByCoordinates(Ex,Dy,zPt);
C = Point.ByCoordinates(Bx,Dy,zPt);

//Geometry 6a
geometry6a = [Imperative]
{
if(H1>W1)
{
//Geometry by arc
plane1 = Plane.ByThreePoints(C, G, F);
plane2 = Plane.ByThreePoints(A, E, H);
x1 = A.DistanceTo(C);
circle1 = Circle.ByPlaneRadius(plane1, x1);
circle2 = Circle.ByPlaneRadius(plane2, x1);
ip1 = circle1.Intersect(circle2);
p1 = ip1[0];
p2 = ip1[1];
v1 = Vector.ByTwoPoints(p1, p2);
v2 = Vector.ByTwoPoints(C, D);
l1 = Line.ByStartPointDirectionLength(p1, v1, 3000);
l2 = Line.ByStartPointDirectionLength(C, v2, 3000);
intP = l1.Intersect(l2);
geometry6a = Arc.ByCenterPointStartPointEndPoint(intP, C, A);
JoinCurves = PolyCurve.ByJoinedCurves(geometry6a);
return= {JoinCurves, C};
}
else
{
//Geometry by ellipse
r1 = W1;
r2 = H1;
plane = Plane.ByThreePoints(D, H, G);
geometry6a = EllipseArc.ByPlaneRadiiAngles(plane, r1, r2, 0, 90);
JoinCurves = PolyCurve.ByJoinedCurves(geometry6a);
return= {JoinCurves, C};
}
};
# ----------------------------------------
code_block = CodeBlock(OUT=n6a_xy.out20) { InfoGeom=OUT[0]; End=OUT[1]; }
n6a = Output(code_block.InfoGeom)  # "6a"
EndPt = Output(code_block.End)
