# Dynamo custom node VRIM.Geometry.world XY.08.8c.dyf "8c" (Dynamo 1.3.2.2480)
# category: VRIM.Geometry.world XY.08

HW = Input(HW:double[]={10,10})
StartPt = Input(StartPt: var=Point.ByCoordinates(0,0,0))
n8c_xy = CodeBlock(HW, StartPt)  # "8c_xy"
# ---------- n8c_xy.designscript (72 lines) ----------
// Copyright(c) 2017, Elisabetta Caterina Giovannini
// Alma Mater Studiorum - University of Bologna
// VRIM project
// www.unibo.it/sitoweb/elisabettacaterina.giovannini/en
// elisabettacaterina.giovannini@unibo.it

//Measurements - 8c
H1=HW[0];
W1=HW[1];
W0= StartPt.X;
H0= StartPt.Y;

//Coordinate System(-x,y)
Ax = W0-W1;
Ay = H0;
Ex = W0-(W1/2);
Bx = W0;
Hy = H0+(H1/2);
Dy = H0+H1;

//9 Points grid
zPt= StartPt.Z;
A = Point.ByCoordinates(Ax,Ay,zPt);
E = Point.ByCoordinates(Ex,Ay,zPt);
B = Point.ByCoordinates(Bx,Ay,zPt);
H = Point.ByCoordinates(Ax,Hy,zPt);
O = Point.ByCoordinates(Ex,Hy,zPt);
F = Point.ByCoordinates(Bx,Hy,zPt);
D = Point.ByCoordinates(Ax,Dy,zPt);
G = Point.ByCoordinates(Ex,Dy,zPt);
C = Point.ByCoordinates(Bx,Dy,zPt);

//Geometry 8c
geometry8c = [Imperative]
{
if(H1>W1)
{
//Geometry by ellipse
r1 = W1/2;
r2 = H1/2;
planeF = Plane.ByThreePoints(F, C, O);
planeH = Plane.ByThreePoints(H, E, O);
Arc1 = EllipseArc.ByPlaneRadiiAngles(planeF, r1, r2, -90, 90);
Arc2 = EllipseArc.ByPlaneRadiiAngles(planeH, r1, r2, 0, -90);
geometry8c = {Arc1, Arc2};
JoinCurves = PolyCurve.ByJoinedCurves(geometry8c);
return= {JoinCurves, D};
}
else
{
//Geometry by arc
x1 = B.DistanceTo(D);
r=((x1/14)*6);
planeB = Plane.ByThreePoints(B, F, E);
planeO = Plane.ByThreePoints(O, G, H);
planeD = Plane.ByThreePoints(D, H, G);
circleB = Circle.ByPlaneRadius(planeB, r);
circleO = Circle.ByPlaneRadius(planeO, r);
circleD = Circle.ByPlaneRadius(planeD, r);
ipB = circleO.Intersect(circleB);
ipD = circleO.Intersect(circleD);
p1 = ipB[1];
p2 = ipB[0];
p3 = ipD[1];
p4 = ipD[0];
Arc1 = Arc.ByCenterPointStartPointEndPoint(p1, B, O);
Arc2 = Arc.ByCenterPointStartPointEndPoint(p4, D, O);
geometry8c = {Arc1, Arc2};
JoinCurves = PolyCurve.ByJoinedCurves(geometry8c);
return= {JoinCurves, D};
}
};
# ----------------------------------------
code_block = CodeBlock(OUT=n8c_xy.out20) { InfoGeom=OUT[0]; End=OUT[1]; }
n8d = Output(code_block.InfoGeom)  # "8d"
EndPt = Output(code_block.End)
