# Dynamo custom node VRIM.Geometry.world XY.09.9a.dyf "9a" (Dynamo 1.3.2.2480)
# category: VRIM.Geometry.world XY.09

HW = Input(HW:double[]={10,10})
StartPt = Input(StartPt: var=Point.ByCoordinates(0,0,0))
n9a = CodeBlock(HW, StartPt)  # "9a"
# ---------- n9a.designscript (39 lines) ----------
// Copyright(c) 2017, Elisabetta Caterina Giovannini
// Alma Mater Studiorum - University of Bologna
// VRIM project
// www.unibo.it/sitoweb/elisabettacaterina.giovannini/en
// elisabettacaterina.giovannini@unibo.it

//Measurements - 9a
H1=HW[0];
W1=HW[1];
W0= StartPt.X;
H0= StartPt.Y;

//Local System (x,-y) centered in H grid point
Ax = W0;
Ay = H0-(H1/2);
Ex = W0+(W1/2);
Bx = W0+W1;
Hy = H0;
Dy = H0+(H1/2);

//9 Points grid
zPt= StartPt.Z;
A = Point.ByCoordinates(Ax,Ay,zPt);
E = Point.ByCoordinates(Ex,Ay,zPt);
B = Point.ByCoordinates(Bx,Ay,zPt);
H = Point.ByCoordinates(Ax,Hy,zPt);
O = Point.ByCoordinates(Ex,Hy,zPt);
F = Point.ByCoordinates(Bx,Hy,zPt);
D = Point.ByCoordinates(Ax,Dy,zPt);
G = Point.ByCoordinates(Ex,Dy,zPt);
C = Point.ByCoordinates(Bx,Dy,zPt);

//Geometry 9a
r1 = W1/2;
r2 = H1/2;
plane = Plane.ByThreePoints(O, G, H);
geometry9a = EllipseArc.ByPlaneRadiiAngles(plane, r1, r2, 90, 270);
JoinCurves = PolyCurve.ByJoinedCurves(geometry9a);
GeometryOutput= {JoinCurves, G};
# ----------------------------------------
code_block = CodeBlock(OUT=n9a.GeometryOutput) { InfoGeom=OUT[0]; End=OUT[1]; }
n9a_2 = Output(code_block.InfoGeom)  # "9a"
EndPt = Output(code_block.End)
