# Dynamo custom node VRIM.Geometry.world XZ.01.1c.dyf "1c" (Dynamo 1.3.2.2480)
# category: VRIM.Geometry.world XZ.01

HW = Input(HW:double[]={10,10})
StartPt = Input(StartPt: var=Point.ByCoordinates(0,0,0))
n1c = CodeBlock(HW, StartPt)  # "1c"
# ---------- n1c.designscript (36 lines) ----------
// Copyright(c) 2017, Elisabetta Caterina Giovannini
// Alma Mater Studiorum - University of Bologna
// VRIM project
// www.unibo.it/sitoweb/elisabettacaterina.giovannini/en
// elisabettacaterina.giovannini@unibo.it

//Measurements - 1c
H1=HW[0];
W1=HW[1];
W0= StartPt.X;
H0= StartPt.Z;

//Local System (-x,z)
Ax = W0-W1;
Az = H0;
Ex = W0-(W1/2);
Bx = W0;
Hz = H0+(H1/2);
Dz = H0+H1;

//9 Points grid
yPt= StartPt.Y;
A = Point.ByCoordinates(Ax,yPt,Az);
E = Point.ByCoordinates(Ex,yPt,Az);
B = Point.ByCoordinates(Bx,yPt,Az);
H = Point.ByCoordinates(Ax,yPt,Hz);
O = Point.ByCoordinates(Ex,yPt,Hz);
F = Point.ByCoordinates(Bx,yPt,Hz);
D = Point.ByCoordinates(Ax,yPt,Dz);
G = Point.ByCoordinates(Ex,yPt,Dz);
C = Point.ByCoordinates(Bx,yPt,Dz);

//Geometry 1c
geometry1c =Line.ByStartPointEndPoint(B, A);
JoinCurves = PolyCurve.ByJoinedCurves(geometry1c);
GeometryOutput= {JoinCurves, A};
# ----------------------------------------
code_block = CodeBlock(OUT=n1c.GeometryOutput) { InfoGeom=OUT[0]; End=OUT[1]; }
n1c_2 = Output(code_block.InfoGeom)  # "1c"
EndPt = Output(code_block.End)
