# Dynamo custom node VRIM.Geometry.world XZ.04.4a.dyf "4a" (Dynamo 1.3.2.2480)
# category: VRIM.Geometry.world XZ.04

HW = Input(HW:double[]={10,10})
StartPt = Input(StartPt: var=Point.ByCoordinates(0,0,0))
n4a = CodeBlock(HW, StartPt)  # "4a"
# ---------- n4a.designscript (40 lines) ----------
// Copyright(c) 2017, Elisabetta Caterina Giovannini
// Alma Mater Studiorum - University of Bologna
// VRIM project
// www.unibo.it/sitoweb/elisabettacaterina.giovannini/en
// elisabettacaterina.giovannini@unibo.it

//Measurements - 4a
H1=HW[0];
W1=HW[1];
W0= StartPt.X;
H0= StartPt.Z;

//Local System (x,z)
Ax = W0;
Az = H0;
Ex = W0+(W1/2);
Bx = W0+W1;
Hz = H0+(H1/2);
Dz = H0+H1;

//9 Points grid
yPt= StartPt.Y;
A = Point.ByCoordinates(Ax,yPt,Az);
E = Point.ByCoordinates(Ex,yPt,Az);
B = Point.ByCoordinates(Bx,yPt,Az);
H = Point.ByCoordinates(Ax,yPt,Hz);
O = Point.ByCoordinates(Ex,yPt,Hz);
F = Point.ByCoordinates(Bx,yPt,Hz);
D = Point.ByCoordinates(Ax,yPt,Dz);
G = Point.ByCoordinates(Ex,yPt,Dz);
C = Point.ByCoordinates(Bx,yPt,Dz);

//Geometry 4a
t1 = {O, E, A};
t2 = {O, F, C};
polyCurve1 = PolyCurve.ByPoints(t1, false);
polyCurve2 = PolyCurve.ByPoints(t2, false);
JoinCurves = {polyCurve1, polyCurve2};
geometry4a = PolyCurve.ByJoinedCurves(JoinCurves);
GeometryOutput= {geometry4a, C};
# ----------------------------------------
code_block = CodeBlock(OUT=n4a.GeometryOutput) { InfoGeom=OUT[0]; End=OUT[1]; }
n4a_2 = Output(code_block.InfoGeom)  # "4a"
EndPt = Output(code_block.End)
