# Dynamo custom node VRIM.Geometry.world XZ.07.7a.dyf "7a" (Dynamo 1.3.2.2480)
# category: VRIM.Geometry.world XZ.07

HW = Input(HW:double[]={10,5})
StartPt = Input(StartPt: var=Point.ByCoordinates(0,0,0))
n7a = CodeBlock(HW, StartPt)  # "7a"
# ---------- n7a.designscript (39 lines) ----------
// Copyright(c) 2017, Elisabetta Caterina Giovannini
// Alma Mater Studiorum - University of Bologna
// VRIM project
// www.unibo.it/sitoweb/elisabettacaterina.giovannini/en
// elisabettacaterina.giovannini@unibo.it

//Measurements - 7a
H1=HW[0];
W1=HW[1];
W0= StartPt.X;
H0= StartPt.Z;

//Local System (x,z) Half grid Coordinates
Ax = W0;
Az = H0;
Ex = W0+W1;
Bx = W0+(W1*2);
Hz = H0+(H1/2);
Dz = H0+H1;

//9 Points grid
yPt= StartPt.Y;
A = Point.ByCoordinates(Ax,yPt,Az);
E = Point.ByCoordinates(Ex,yPt,Az);
B = Point.ByCoordinates(Bx,yPt,Az);
H = Point.ByCoordinates(Ax,yPt,Hz);
O = Point.ByCoordinates(Ex,yPt,Hz);
F = Point.ByCoordinates(Bx,yPt,Hz);
D = Point.ByCoordinates(Ax,yPt,Dz);
G = Point.ByCoordinates(Ex,yPt,Dz);
C = Point.ByCoordinates(Bx,yPt,Dz);

//Geometry 7a
r1 = W1;
r2 = H1/2;
plane = Plane.ByThreePoints(H, O, D);
geometry7a = EllipseArc.ByPlaneRadiiAngles(plane, r2, r1, 0, 180);
JoinCurves = PolyCurve.ByJoinedCurves(geometry7a);
geometryOutput= {JoinCurves, D};
# ----------------------------------------
code_block = CodeBlock(OUT=n7a.geometryOutput) { InfoGeom=OUT[0]; End=OUT[1]; }
n7a_2 = Output(code_block.InfoGeom)  # "7a"
EndPt = Output(code_block.End)
