# Dynamo custom node VRIM.Geometry.world XZ.07.7c.dyf "7c" (Dynamo 1.3.2.2480)
# category: VRIM.Geometry.world XZ.07

HW = Input(HW:double[]={10,5})
StartPt = Input(StartPt: var=Point.ByCoordinates(0,0,0))
n7c = CodeBlock(HW, StartPt)  # "7c"
# ---------- n7c.designscript (39 lines) ----------
// Copyright(c) 2017, Elisabetta Caterina Giovannini
// Alma Mater Studiorum - University of Bologna
// VRIM project
// www.unibo.it/sitoweb/elisabettacaterina.giovannini/en
// elisabettacaterina.giovannini@unibo.it

//Measurements - 7c
H1=HW[0];
W1=HW[1];
W0= StartPt.X;
H0= StartPt.Z;

//Local System (-x,z)
Ax = W0-(W1*2);
Az = H0;
Ex = W0-W1;
Bx = W0;
Hz = H0+(H1/2);
Dz = H0+H1;

//9 Points grid
yPt= StartPt.Y;
A = Point.ByCoordinates(Ax,yPt,Az);
E = Point.ByCoordinates(Ex,yPt,Az);
B = Point.ByCoordinates(Bx,yPt,Az);
H = Point.ByCoordinates(Ax,yPt,Hz);
O = Point.ByCoordinates(Ex,yPt,Hz);
F = Point.ByCoordinates(Bx,yPt,Hz);
D = Point.ByCoordinates(Ax,yPt,Dz);
G = Point.ByCoordinates(Ex,yPt,Dz);
C = Point.ByCoordinates(Bx,yPt,Dz);

//Geometry 7c
r1 = W1;
r2 = H1/2;
plane = Plane.ByThreePoints(F, C, O);
geometry7c = EllipseArc.ByPlaneRadiiAngles(plane, r1, r2, -90, 180);
JoinCurves = PolyCurve.ByJoinedCurves(geometry7c);
geometryOutput= {JoinCurves, C};
# ----------------------------------------
code_block = CodeBlock(OUT=n7c.geometryOutput) { InfoGeom=OUT[0]; End=OUT[1]; }
n7c_2 = Output(code_block.InfoGeom)  # "7c"
EndPt = Output(code_block.End)
