# Dynamo custom node VRIM.Geometry.world XZ.10.10a.dyf "10a" (Dynamo 1.3.2.2480)
# category: VRIM.Geometry.world XZ.10

HW = Input(HW:double[]={10,10})
StartPt = Input(StartPt: var=Point.ByCoordinates(0,0,0))
n10a = CodeBlock(HW, StartPt)  # "10a"
# ---------- n10a.designscript (40 lines) ----------
// Copyright(c) 2017, Elisabetta Caterina Giovannini
// Alma Mater Studiorum - University of Bologna
// VRIM project
// www.unibo.it/sitoweb/elisabettacaterina.giovannini/en
// elisabettacaterina.giovannini@unibo.it

//Measurements - 10a
H1=HW[0];
W1=HW[1];
W0= StartPt.X;
H0= StartPt.Z;

//Local System (x,z) centered in O grid point
Ax = W0-(W1/2);
Az = H0-(H1/2);
Ex = W0;
Bx = H0+(H1/2);
Hz = H0;
Dz = H0+(H1/2);


//9 Points grid
yPt= StartPt.Y;
A = Point.ByCoordinates(Ax,yPt,Az);
E = Point.ByCoordinates(Ex,yPt,Az);
B = Point.ByCoordinates(Bx,yPt,Az);
H = Point.ByCoordinates(Ax,yPt,Hz);
O = Point.ByCoordinates(Ex,yPt,Hz);
F = Point.ByCoordinates(Bx,yPt,Hz);
D = Point.ByCoordinates(Ax,yPt,Dz);
G = Point.ByCoordinates(Ex,yPt,Dz);
C = Point.ByCoordinates(Bx,yPt,Dz);

//Geometry 10a
r1 = W1/2;
r2 = H1/2;
plane = Plane.ByThreePoints(O, G, H);
geometry10a = EllipseArc.ByPlaneRadiiAngles(plane, r1, r2, 0, 360);
JoinCurves = PolyCurve.ByJoinedCurves(geometry10a);
GeometryOutput= {JoinCurves, O};
# ----------------------------------------
code_block = CodeBlock(OUT=n10a.GeometryOutput) { InfoGeom=OUT[0]; End=OUT[1]; }
n10a_2 = Output(code_block.InfoGeom)  # "10a"
EndPt = Output(code_block.End)
