# Dynamo custom node VRIM.Geometry.world XZ.11.11b.dyf "11b" (Dynamo 1.3.2.2480)
# category: VRIM.Geometry.world XZ.11

code_block = CodeBlock {  }
HW = Input(HW:double[]={10,10})
StartPt = Input(StartPt: var=Point.ByCoordinates(0,0,0))
n11b = CodeBlock(HW, StartPt)  # "11b"
# ---------- n11b.designscript (36 lines) ----------
// Copyright(c) 2017, Elisabetta Caterina Giovannini
// Alma Mater Studiorum - University of Bologna
// VRIM project
// www.unibo.it/sitoweb/elisabettacaterina.giovannini/en
// elisabettacaterina.giovannini@unibo.it

//Measurements - 11b
H1=HW[0];
W1=HW[1];
W0= StartPt.X;
H0= StartPt.Z;

//Local System (-x,y)
Ax = W0;
Az = H0-H1;
Ex = W0+(W1/2);
Bx = W0+W1;
Hz = H0-(H1/2);
Dz = H0;

//9 Points grid
yPt= StartPt.Y;
A = Point.ByCoordinates(Ax,yPt,Az);
E = Point.ByCoordinates(Ex,yPt,Az);
B = Point.ByCoordinates(Bx,yPt,Az);
H = Point.ByCoordinates(Ax,yPt,Hz);
O = Point.ByCoordinates(Ex,yPt,Hz);
F = Point.ByCoordinates(Bx,yPt,Hz);
D = Point.ByCoordinates(Ax,yPt,Dz);
G = Point.ByCoordinates(Ex,yPt,Dz);
C = Point.ByCoordinates(Bx,yPt,Dz);

//Geometry 11b
t1 = {D, B};
geometry11b = PolyCurve.ByPoints(t1, false);
GeometryOutput= {geometry11b, B};
# ----------------------------------------
code_block_2 = CodeBlock(OUT=n11b.GeometryOutput) { InfoGeom=OUT[0]; End=OUT[1]; }
EndPt = Output(code_block_2.End)
n11b_2 = Output(code_block_2.InfoGeom)  # "11b"
