# Dynamo custom node VRIM.Geometry.world XZ.11.11d.dyf "11d" (Dynamo 1.3.2.2480)
# category: VRIM.Geometry.world XZ.11

HW = Input(HW:double[]={10,10})
StartPt = Input(StartPt: var=Point.ByCoordinates(0,0,0))
n11d = CodeBlock(HW, StartPt)  # "11d"
# ---------- n11d.designscript (36 lines) ----------
// Copyright(c) 2017, Elisabetta Caterina Giovannini
// Alma Mater Studiorum - University of Bologna
// VRIM project
// www.unibo.it/sitoweb/elisabettacaterina.giovannini/en
// elisabettacaterina.giovannini@unibo.it

//Measurements - 11d
H1=HW[0];
W1=HW[1];
W0= StartPt.X;
H0= StartPt.Z;

//Local System (-x,-y)
Ax = W0-W1;
Az = H0-H1;
Ex = W0-(W1/2);
Bx = W0;
Hz = H0-(H1/2);
Dz = H0;

//9 Points grid
yPt= StartPt.Y;
A = Point.ByCoordinates(Ax,yPt,Az);
E = Point.ByCoordinates(Ex,yPt,Az);
B = Point.ByCoordinates(Bx,yPt,Az);
H = Point.ByCoordinates(Ax,yPt,Hz);
O = Point.ByCoordinates(Ex,yPt,Hz);
F = Point.ByCoordinates(Bx,yPt,Hz);
D = Point.ByCoordinates(Ax,yPt,Dz);
G = Point.ByCoordinates(Ex,yPt,Dz);
C = Point.ByCoordinates(Bx,yPt,Dz);

//Geometry 11d
geometry11d =Line.ByStartPointEndPoint(C, A);
JoinCurves = PolyCurve.ByJoinedCurves(geometry11d);
GeometryOutput= {JoinCurves, A};
# ----------------------------------------
code_block = CodeBlock(OUT=n11d.GeometryOutput) { InfoGeom=OUT[0]; End=OUT[1]; }
EndPt = Output(code_block.End)
n11d_2 = Output(code_block.InfoGeom)  # "11d"
