# Dynamo custom node VRIM.ProfilesAndPaths.CloseProfile (-).dyf "CloseProfile (-)" (Dynamo 1.3.2.2480)
# category: VRIM.ProfilesAndPaths

StartPt = Input(StartPt: var=Point.ByCoordinates(0,0,0))
EndPt = Input()
Moulding = Input()
closeprofile = CodeBlock(StartPt=StartPt, EndPt=EndPt, Moulding=Moulding)
# ---------- closeprofile.designscript (25 lines) ----------
// Copyright(c) 2017, Elisabetta Caterina Giovannini
// Alma Mater Studiorum - University of Bologna
// VRIM project
// www.unibo.it/sitoweb/elisabettacaterina.giovannini/en
// elisabettacaterina.giovannini@unibo.it


// Punti di inizio e fine CloseProfile
StartPt;
EndPt;
Moulding;

W = Point.ByCoordinates(StartPt.X,EndPt.Y,EndPt.Z);
t1= {StartPt, W, EndPt};
Profile = PolyCurve.ByPoints(t1, false);

// Close Profile and filter geometries from List

GetProfile = {Moulding, Profile};
UnionList= Flatten(GetProfile);
SelectNumbers=DSCore.Object.Type(UnionList);
SeparateGeometries=String.Contains(SelectNumbers, "System", false);
FilterGeometries=List.FilterByBoolMask(UnionList, SeparateGeometries);
GetCurves=__TryGetValueFromNestedDictionaries(FilterGeometries, "out");
polyCurve = PolyCurve.ByJoinedCurves(GetCurves);
# ----------------------------------------
Profile = Output(closeprofile.polyCurve)
Same_Sequence = Output(closeprofile.W)
