# Dynamo custom node VRIM.ProfilesAndPaths.CloseProfileForSequence.dyf "CloseProfileForSequence" (Dynamo 1.3.2.2480)
# category: VRIM.ProfilesAndPaths

StartPt = Input()
EndPt = Input()
SameSequence = Input()
Moulding = Input()
closeProfile_Sequence_xy = CodeBlock(StartPt=StartPt, EndPt=EndPt, SameSequence=SameSequence, Moulding=Moulding)
# ---------- closeProfile_Sequence_xy.designscript (25 lines) ----------
// Copyright(c) 2017, Elisabetta Caterina Giovannini
// Alma Mater Studiorum - University of Bologna
// VRIM project
// www.unibo.it/sitoweb/elisabettacaterina.giovannini/en
// elisabettacaterina.giovannini@unibo.it

// Punti di inizio e fine CloseProfile
StartPt;
EndPt;
SameSequence;

V = Point.ByCoordinates(SameSequence.X, StartPt.Y, StartPt.Z);
W = Point.ByCoordinates(SameSequence.X, EndPt.Y, EndPt.Z);

t1 = {StartPt, V, W, EndPt};

Profile = PolyCurve.ByPoints(t1, false);
GetProfile = {Moulding, Profile};
// Close Profile and filter geometries from List
UnionList= Flatten(GetProfile);
SelectNumbers=DSCore.Object.Type(UnionList);
SeparateGeometries=String.Contains(SelectNumbers, "System", false);
FilterGeometries=List.FilterByBoolMask(UnionList, SeparateGeometries);
GetCurves=__TryGetValueFromNestedDictionaries(FilterGeometries, "out");
polyCurve = PolyCurve.ByJoinedCurves(GetCurves);
# ----------------------------------------
Same_Sequence = Output(closeProfile_Sequence_xy.SameSequence)
Profile = Output(closeProfile_Sequence_xy.polyCurve)
