# Dynamo custom node VRIM.ProfilesAndPaths.CloseProfileWithOffset.dyf "CloseProfileWithOffset" (Dynamo 1.3.2.2480)
# category: VRIM.ProfilesAndPaths

StartPt = Input(StartPt: var=Point.ByCoordinates(0,0,0))
EndPt = Input()
OffsetIN = Input(OffsetIN: var=1)
Moulding = Input()
closeProfile_Offset = CodeBlock(StartPt=StartPt, EndPt=EndPt, OffsetIN=OffsetIN, Moulding=Moulding)
# ---------- closeProfile_Offset.designscript (27 lines) ----------
// Copyright(c) 2017, Elisabetta Caterina Giovannini
// Alma Mater Studiorum - University of Bologna
// VRIM project
// www.unibo.it/sitoweb/elisabettacaterina.giovannini/en
// elisabettacaterina.giovannini@unibo.it

// Punti di inizio e fine CloseProfile
StartPt;
EndPt;
OffsetIN;
L0=StartPt.X;
Vx= L0+OffsetIN;

V = Point.ByCoordinates(Vx, StartPt.Y, StartPt.Z);
W = Point.ByCoordinates(Vx, EndPt.Y, EndPt.Z);

t1 = {StartPt, V, W, EndPt};

Profile = PolyCurve.ByPoints(t1, false);
GetProfile = {Moulding, Profile};
// Close Profile and filter geometries from List
UnionList= Flatten(GetProfile);
SelectNumbers=DSCore.Object.Type(UnionList);
SeparateGeometries=String.Contains(SelectNumbers, "System", false);
FilterGeometries=List.FilterByBoolMask(UnionList, SeparateGeometries);
GetCurves=__TryGetValueFromNestedDictionaries(FilterGeometries, "out");
polyCurve = PolyCurve.ByJoinedCurves(GetCurves);
# ----------------------------------------
Same_Sequence = Output(closeProfile_Offset.W)
Profile = Output(closeProfile_Offset.polyCurve)
