# Dynamo custom node VRIM.ProfilesAndPaths.OffSetFromStartPtAndEndPt.dyf "OffSetFromStartPtAndEndPt" (Dynamo 1.3.2.2480)
# category: VRIM.ProfilesAndPaths

StartPt = Input(StartPt: var=Point.ByCoordinates(0,0,0))
EndPt = Input()
OffsetIN = Input()
offsetIN = CodeBlock(StartPt=StartPt, EndPt=EndPt, OffsetIN=OffsetIN)
# ---------- offsetIN.designscript (13 lines) ----------
// Copyright(c) 2017, Elisabetta Caterina Giovannini
// Alma Mater Studiorum - University of Bologna
// VRIM project
// www.unibo.it/sitoweb/elisabettacaterina.giovannini/en
// elisabettacaterina.giovannini@unibo.it

StartPt;
EndPt;
OffsetIN;
Vx= StartPt.X-OffsetIN;

V = Point.ByCoordinates(Vx, EndPt.Y, EndPt.Z);
OffSet= StartPt.X-Vx;
# ----------------------------------------
OffsetIN_2 = Output(offsetIN.OffSet)  # "OffsetIN"
