# Dynamo custom node VRIM.Revit.SetParameterValue.dyf "SetParameterValue" (Dynamo 1.3.2.2480)
# category: VRIM.Revit

code_block = CodeBlock()
# ---------- code_block.designscript (38 lines) ----------
// Copyright(c) 2017, Elisabetta Caterina Giovannini
// Alma Mater Studiorum - University of Bologna
// VRIM project
// www.unibo.it/sitoweb/elisabettacaterina.giovannini/en
// elisabettacaterina.giovannini@unibo.it
// Script Reference Link
// https://forum.dynamobim.com/t/set-parameter-inside-the-family-it-was-created/5919

"
import clr
clr.AddReference('RevitAPI')
from Autodesk.Revit.DB import*

clr.AddReference('RevitServices')
from RevitServices.Persistence import DocumentManager
from RevitServices.Transactions import TransactionManager

doc = DocumentManager.Instance.CurrentDBDocument

param_name = IN[0]
param_value = IN[1]

param_list = doc.FamilyManager.GetParameters()
names = [p.Definition.Name for p in param_list]
par1 = None
if param_name in names:
 par1 = param_list[names.index(param_name)]
if par1 != None:
 TransactionManager.Instance.EnsureInTransaction(doc)
 try :
  doc.FamilyManager.Set(par1,param_value)
  OUT = 'Success'
 except:
  OUT = 'Failed'
 TransactionManager.Instance.TransactionTaskDone()
else :
 OUT = 'Failed';
";
# ----------------------------------------
Parameter_Name = Input()
Parameter_Value = Input()
formula = Formula("x/30.48", x=Parameter_Value)
python_script_from_string = PythonStringNode(script=code_block, IN[0]=Parameter_Name, IN[1]=formula)
