# Dynamo custom node VRIM.Solid.SolidByProfileAndPath.dyf "SolidByProfileAndPath" (Dynamo 1.3.2.2480)
# category: VRIM.Solid

StartPoint = Input()
EndPoint = Input()
OffsetIN = Input()
Profile = Input()
Path = Input()
solid_Offset = CodeBlock(StartPt=StartPoint, EndPt=EndPoint, OffsetIN=OffsetIN, Moulding=Profile, Path=Path)
# ---------- solid_Offset.designscript (29 lines) ----------
// Copyright(c) 2017, Elisabetta Caterina Giovannini
// Alma Mater Studiorum - University of Bologna
// VRIM project
// www.unibo.it/sitoweb/elisabettacaterina.giovannini/en
// elisabettacaterina.giovannini@unibo.it

// Punti di inizio e fine CloseProfile
StartPt;
EndPt;
OffsetIN;
L0=StartPt.X;
Vx= L0-OffsetIN;

V = Point.ByCoordinates(Vx, StartPt.Y, StartPt.Z);
W = Point.ByCoordinates(Vx, EndPt.Y, EndPt.Z);

t1 = {StartPt, V, W, EndPt};

Profile = PolyCurve.ByPoints(t1, false);
GetProfile = {Moulding, Profile};
// Close Profile and filter geometries from List
UnionList= Flatten(GetProfile);
SelectNumbers=DSCore.Object.Type(UnionList);
SeparateGeometries=String.Contains(SelectNumbers, "System", false);
FilterGeometries=List.FilterByBoolMask(UnionList, SeparateGeometries);
GetCurves=__TryGetValueFromNestedDictionaries(FilterGeometries, "out");
polyCurve = PolyCurve.ByJoinedCurves(GetCurves);
solid = Solid.BySweep(polyCurve, Path);
SameSequence= {W, EndPt, Path};
# ----------------------------------------
Same_Sequence = Output(solid_Offset.SameSequence)
Solid = Output(solid_Offset.solid)
