# Dynamo custom node VRIM.Solid.SolidForSequence.dyf "SolidForSequence" (Dynamo 1.3.2.2480)
# category: VRIM.Solid

EndPt = Input()
SameSequence = Input()
Moulding = Input()
solidForSequence = CodeBlock(EndPt=EndPt, SameSequence=SameSequence, Moulding=Moulding)
# ---------- solidForSequence.designscript (30 lines) ----------
// Copyright(c) 2017, Elisabetta Caterina Giovannini
// Alma Mater Studiorum - University of Bologna
// VRIM project
// www.unibo.it/sitoweb/elisabettacaterina.giovannini/en
// elisabettacaterina.giovannini@unibo.it

// Punti di inizio e fine CloseProfile

EndPt;
SameSequence[0];
StartPt= SameSequence[1];
Path= SameSequence[2];

V = SameSequence[0];
W = Point.ByCoordinates(SameSequence[0].X, EndPt.Y, EndPt.Z);

t1 = {StartPt, V, W, EndPt};

Profile = PolyCurve.ByPoints(t1, false);
GetProfile = {Moulding, Profile};

// Close Profile and filter geometries from List
UnionList= Flatten(GetProfile);
SelectNumbers=DSCore.Object.Type(UnionList);
SeparateGeometries=String.Contains(SelectNumbers, "System", false);
FilterGeometries=List.FilterByBoolMask(UnionList, SeparateGeometries);
GetCurves=__TryGetValueFromNestedDictionaries(FilterGeometries, "out");
polyCurve = PolyCurve.ByJoinedCurves(GetCurves);
solid = Solid.BySweep(polyCurve, Path);
Output = {W, EndPt, Path};
# ----------------------------------------
Same_Sequence = Output(solidForSequence.Output)
Solid = Output(solidForSequence.solid)
watch = Watch(solidForSequence.StartPt)
watch_2 = Watch(solidForSequence.Path)
watch_3 = Watch(solidForSequence.out1)
